# Grasshopper definition capsule-dream.gh (Grasshopper 1.0.8)
# Copyright: GNU Lesser General Public License Version 3
# plug-ins: RhinoCodePluginGH, semio

sep = Separator()  # -> S; same code as sep
dir = Directory()  # -> D
# ---------- dir: C# ----------
#region Usings
using System;
using System.Linq;
using System.Collections;
using System.Collections.Generic;
using System.Drawing;
using System.IO;

using Rhino;
using Rhino.Geometry;

using Grasshopper;
using Grasshopper.Kernel;
using Grasshopper.Kernel.Data;
using Grasshopper.Kernel.Types;
#endregion

public class Script_Instance : GH_ScriptInstance
{
    private void RunScript(ref object D)
    {
        D = Path.GetDirectoryName(this.GrasshopperDocument.FilePath);
    }
}
# ---------- end dir ----------
# ^                                    ^
#    |                                     |
# <-- Constants    Preview -->
# Parameters    External    Local -->
# <-- Meta               |
#      |                       v
#      v
par = ParentDirectory(D=dir)  # -> P; inputs D: String
# ---------- par: C# ----------
#region Usings
using System;
using System.Linq;
using System.Collections;
using System.Collections.Generic;
using System.Drawing;
using System.IO;

using Rhino;
using Rhino.Geometry;

using Grasshopper;
using Grasshopper.Kernel;
using Grasshopper.Kernel.Data;
using Grasshopper.Kernel.Types;
#endregion

public class Script_Instance : GH_ScriptInstance
{
    private void RunScript(string D, ref object P)
    {
        P = new DirectoryInfo(D).Parent;
    }
}
# ---------- end par ----------

load_kit = BooleanToggle(False)
kit = CacheKit(uri=par, R=load_kit)  # -> kt_2, ty_2, dn_2, rp_2, ur_2, objects_2, urpa_2, urpalc_2, urpare_2
ty = Type([null x45])
objects = Data(Tree({0;0;0}: [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], {0;0;1}: [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], {0;0;2}: [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], {0;0;3}: [], {0;0;4}: [], {0;0;5}: [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]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))
dn = Design([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])

variant = GetString("", AtLeast=0, AtMost=1, TreeAccess=False)
view = GetString("", AtLeast=0, AtMost=1, TreeAccess=False)

# ----
# Reuse designs
panel = Panel("Nakagin Capsule Tower")
# Outputs   ->
#                 |
#                 v
panel_2 = Panel("Explosion Axonometry")
dsn = SelectDesign(dn=dn, na=panel)
dsn_2 = SelectDesign(dn=dn, na=panel, variant="Slanted")
dsn_3 = SelectDesign(dn=dn, na=panel, variant="Dancing", view=panel_2)
dsn_4 = SelectDesign(dn=dn, na=panel, variant="Twisted")
dancing = Design(dsn_3)
original = Design(dsn)
slanted = Design(dsn_2)
twisted = Design(dsn_4)

# ----
# Orient
pln = Plane(Plane(origin=(0, 27.5, 0), x=(0, 1, 0), y=(-1, 0, 0)))
pln_2 = Plane(Plane(origin=(110, 0, 0), x=(-1, 0, 0), y=(0, -1, 0)))
pln_3 = Plane(PlaneXY(27.5, 137.5, 0))
pln_4 = Plane(Plane(origin=(137.5, 110, 0), x=(0, -1, 0), y=(1, 0, 0)))
orient = Orient(Source=PlaneXY(0, 0, 0), Target=pln_4)  # -> Geometry, Transform
orient_2 = Orient(Source=PlaneXY(0, 0, 0), Target=pln)  # -> Geometry, Transform
orient_3 = Orient(Source=PlaneXY(0, 0, 0), Target=pln_3)  # -> Geometry, Transform
orient_4 = Orient(Source=PlaneXY(0, 0, 0), Target=pln_2)  # -> Geometry, Transform
dsn_5 = MoveDesign(dn=original, pn=orient_2.Transform)
dsn_6 = MoveDesign(dn=slanted, pn=orient_3.Transform)
dsn_7 = MoveDesign(dn=twisted, pn=orient_4.Transform)
dsn_8 = MoveDesign(dn=dancing, pn=orient.Transform)

energy_global_warming_potential_kgco2e_k = ValueList({"Natural Gas": 0.201, "Heating Oil": 0.216, "Electricity Non-Renewable": 0.5, "Electricity Renewable": 0}, selected="Natural Gas")  # "Energy Global Warming Potential [kgCO2e/kWh]"
energy_global_warming_potential_kgco2e_k_2 = ValueList({"Natural Gas": 0.201, "Heating Oil": 0.216, "Electricity Non-Renewable": 0.5, "Electricity Renewable": 0}, selected="Electricity Non-Renewable")  # "Energy Global Warming Potential [kgCO2e/kWh]"
energy_price_kwh = ValueList({"Natural Gas": 0.095, "Heating Oil": 0.10, "Electricity Non-Renewable": 0.25, "Electrictiy Renewable": 0.35}, selected="Natural Gas")
energy_price_kwh_2 = ValueList({"Natural Gas": 0.095, "Heating Oil": 0.10, "Electricity Non-Renewable": 0.25, "Electrictiy Renewable": 0.35}, selected="Electricity Non-Renewable")

# ----
# Interpolate between
number_slider = Slider(0.33, range=0..1)
expression = Expression(x=number_slider, Expression="1-x")
inpdsn = InterpolateDesigns(S=dsn_5, T=dsn_6, t=number_slider)  # -> dn_s_u_t_2, dn_s_t_2, dn_t_s_2
inpdsn_2 = InterpolateDesigns(S=dsn_5, T=dsn_6, t=expression)  # -> dn_s_u_t_2, dn_s_t_2, dn_t_s_2
inpdsn_3 = InterpolateDesigns(S=dsn_5, T=dsn_7, t=number_slider)  # -> dn_s_u_t_2, dn_s_t_2, dn_t_s_2
inpdsn_4 = InterpolateDesigns(S=dsn_5, T=dsn_7, t=expression)  # -> dn_s_u_t_2, dn_s_t_2, dn_t_s_2
inpdsn_5 = InterpolateDesigns(S=dsn_6, T=dsn_8, t=number_slider)  # -> dn_s_u_t_2, dn_s_t_2, dn_t_s_2
inpdsn_6 = InterpolateDesigns(S=dsn_6, T=dsn_8, t=expression)  # -> dn_s_u_t_2, dn_s_t_2, dn_t_s_2
inpdsn_7 = InterpolateDesigns(S=dsn_7, T=dsn_8, t=number_slider)  # -> dn_s_u_t_2, dn_s_t_2, dn_t_s_2
inpdsn_8 = InterpolateDesigns(S=dsn_7, T=dsn_8, t=expression)  # -> dn_s_u_t_2, dn_s_t_2, dn_t_s_2

inpdsn_9 = InterpolateDesigns(S=dsn_6, T=dsn_7, t=number_slider)  # -> dn_s_u_t_2, dn_s_t_2, dn_t_s_2
inpdsn_10 = InterpolateDesigns(S=dsn_6, T=dsn_7, t=expression)  # -> dn_s_u_t_2, dn_s_t_2, dn_t_s_2
inpdsn_11 = InterpolateDesigns(S=dsn_5, T=dsn_8, t=number_slider)  # -> dn_s_u_t_2, dn_s_t_2, dn_t_s_2
inpdsn_12 = InterpolateDesigns(S=dsn_5, T=dsn_8, t=expression)  # -> dn_s_u_t_2, dn_s_t_2, dn_t_s_2
heating_energy_price_cent_kwh = Number(energy_price_kwh)
heating_global_warming_potential_kgco2e = Number(energy_global_warming_potential_kgco2e_k)  # "Heating Global Warming Potential [kgCO2e/kWh]"
cooling_efficiency_factor = Number(Slider(0.9, range=0.5..4))
electrictiy_global_warming_potential_kgc = Number(energy_global_warming_potential_kgco2e_k_2)  # "Electrictiy Global Warming Potential [kgCO2e/kWh]"
heating_efficiency_factor = Number(Slider(0.9, range=0.5..4))
cooling_energy_price_cent_kwh = Number(energy_price_kwh_2)
cooling_global_warming_potential_kgco2e = Number(energy_global_warming_potential_kgco2e_k_2)  # "Cooling Global Warming Potential [kgCO2e/kWh]"
electrictiy_energy_price_cent_kwh = Number(energy_price_kwh_2)

aut = ModelAuthor(Name="Ueli Saluz", Email="ueli@semio-tech.org")  # -> Author, Valid, Name, Email

concat = Concatenate(FragmentA="images/", FragmentB="capsule-dream", FragmentC=".png")

concat_2 = Concatenate(FragmentA="icons/", FragmentB="capsule-dream", FragmentC=".svg")

# ----
# Merge designs
merge = Merge(
    Data1=dsn_5,
    Data2=dsn_6,
    Data3=dsn_8,
    Data4=dsn_7,
    Data5=inpdsn.dn_s_u_t_2,
    Data6=inpdsn_2.dn_s_u_t_2,
    Data7=inpdsn_3.dn_s_u_t_2,
    Data8=inpdsn_4.dn_s_u_t_2,
    Data9=inpdsn_5.dn_s_u_t_2,
    Data10=inpdsn_6.dn_s_u_t_2,
    Data11=inpdsn_7.dn_s_u_t_2,
    Data12=inpdsn_8.dn_s_u_t_2,
    Data13=inpdsn_9.dn_s_u_t_2,
    Data14=inpdsn_10.dn_s_u_t_2,
    Data15=inpdsn_11.dn_s_u_t_2,
    Data16=inpdsn_12.dn_s_u_t_2)
dsns = MergeDesigns(
    dn=merge,
    na="Capsule Dream",
    description="A wild dream of capsule towers.",
    icon=concat_2,
    image=concat,
    variant=variant,
    view=view,
    authors=aut.Author)

# ----
# Do some calculations based on metadata
prf = AssessPerformance(
    dn=dsns,
    ty=ty,
    heating_efficiency_factor=heating_efficiency_factor,
    heating_energy_price_kwh=heating_energy_price_cent_kwh,
    heating_global_warming_potential_kgco2e=heating_global_warming_potential_kgco2e,
    cooling_efficiency_factor=cooling_efficiency_factor,
    cooling_global_warming_potential_kgco2e=cooling_global_warming_potential_kgco2e,
    cooling_energy_price_kwh=cooling_energy_price_cent_kwh,
    electrictiy_global_warming_potential_kgc=electrictiy_global_warming_potential_kgc,
    electrictiy_energy_price_kwh=electrictiy_energy_price_cent_kwh)  # -> dn_3, interest_2, area_efficiency_eff_m²_m²_2, area_comfort_m²_person_2, income_a_3, expenses_a_3, energy_expenses_a_3, effective_floor_area_m²_12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; disabled
expression_2 = Expression(x=prf.construction_cost_5, Expression="x/1000000")
expression_3 = Expression(Expression="x/1000000")
expression_4 = Expression(x=prf.expenses_a_3, Expression="x/1000000")
expression_5 = Expression(x=prf.income_a_3, Expression="x/1000000")
expression_6 = Expression(Expression="x/1000000")
expression_7 = Expression(x=prf.energy_expenses_a_3, Expression="x/1000000")
expression_8 = Expression(x=prf.construction_global_warming_potential_kg_2, Expression="x/1000")
expression_9 = Expression(Expression="x/1000")
expression_10 = Expression(x=prf.heating_energy_demand_kwh_a_5, Expression="x/1000")
expression_11 = Expression(x=prf.cooling_energy_demand_kwh_a_5, Expression="x/1000")
expression_12 = Expression(Expression="x/1000")
roundmult = RoundToMultiple(N=expression_5, M="0.05")  # -> R; inputs N: tree, M: tree
# ---------- roundmult: Python ----------
#Component Information
#--------------------------------------------------------------------------------------------
if ghenv.Component.RunCount<2:
    #General
    #--------------------------------------------------------------------------------------------
    __author__ = "YOUR NAME"
    __version__ = "2000.00.00"
    
    ghenv.Component.Name = "Round to Multiple"
    ghenv.Component.NickName = "RoundMult"
    ghenv.Component.Description = "Rounds a number to the nearest specified multiple."
    ghenv.Component.Message = "VER 1.0"
    ghenv.Component.Category = "Math"
    ghenv.Component.SubCategory = "Arithmetic"
    
     #Inputs
    #--------------------------------------------------------------------------------------------
    inputIndex=0
    
    ghenv.Component.Params.Input[inputIndex].Name = "Number"
    ghenv.Component.Params.Input[inputIndex].NickName = "N"
    ghenv.Component.Params.Input[inputIndex].Description = "Number to round."
    ghenv.Component.Params.Input[inputIndex].Optional = False
    inputIndex+=1
    
    ghenv.Component.Params.Input[inputIndex].Name = "Multiple"
    ghenv.Component.Params.Input[inputIndex].NickName = "M"
    ghenv.Component.Params.Input[inputIndex].Description = "Multiple to round to."
    ghenv.Component.Params.Input[inputIndex].Optional = False
    inputIndex+=1
    
    #Outputs
    #--------------------------------------------------------------------------------------------
    outputIndex=0
    
    ghenv.Component.Params.Output[outputIndex].Name = "Rounded"
    ghenv.Component.Params.Output[outputIndex].NickName = "R"
    ghenv.Component.Params.Output[outputIndex].Description = "Number rounded to the nearest specified multiple."
    outputIndex+=1


#Imports
#--------------------------------------------------------------------------------------------
from System import Object
from Grasshopper import DataTree
import math


#The Component function - Business logic only (e.g. working without trees)
#--------------------------------------------------------------------------------------------
"""Function that this component is computing.
    Inputs:
        number: The number to round.
        multiple: The multiple to round to.
    Output:
        rounded: The number rounded to the nearest specified multiple."""
def RoundToMultiple(number, multiple):
    rounded = math.ceil(number / multiple) * multiple
    return rounded

#Solver - Run with trees to enhance performance drastically
#--------------------------------------------------------------------------------------------
if __name__ == "__main__":
    
    #Initialize trees
    #--------------------------------------------------------------------------------------------
    RoundedTree = DataTree[Object]()
    
    #Data matching
    #--------------------------------------------------------------------------------------------
    for path in N.Paths:
        numberBranch = N.Branch(path)
        for i, number in enumerate(numberBranch):
            multiple = M.Branch(path)[i]
            rounded = RoundToMultiple(number, multiple)
            RoundedTree.Add(rounded, path)
    
     #Assign trees to output
    #--------------------------------------------------------------------------------------------
    R = RoundedTree
# ---------- end roundmult ----------
roundmult_2 = RoundToMultiple(N=expression_4, M="0.05")  # -> R; inputs N: tree, M: tree; same code as roundmult
roundmult_3 = RoundToMultiple(N=prf.specific_final_energy_demand_kwh_m²a_2, M="2.5")  # -> R; inputs N: tree, M: tree; same code as roundmult
roundmult_4 = RoundToMultiple(N=expression_7, M="0.05")  # -> R; inputs N: tree, M: tree; same code as roundmult
roundmult_5 = RoundToMultiple(N=expression_10, M=1)  # -> R; inputs N: tree, M: tree; same code as roundmult
roundmult_6 = RoundToMultiple(N=expression_11, M=1)  # -> R; inputs N: tree, M: tree; same code as roundmult
roundmult_7 = RoundToMultiple(N=expression_12, M=1)  # -> R; inputs N: tree, M: tree; same code as roundmult
roundmult_8 = RoundToMultiple(N=prf.effective_floor_area_m²_12, M="25")  # -> R; inputs N: tree, M: tree; same code as roundmult
roundmult_9 = RoundToMultiple(M=1)  # -> R; inputs N: tree, M: tree; same code as roundmult
roundmult_10 = RoundToMultiple(N=expression_2, M="0.05")  # -> R; inputs N: tree, M: tree; same code as roundmult
roundmult_11 = RoundToMultiple(N=expression_6, M="0.05")  # -> R; inputs N: tree, M: tree; same code as roundmult
roundmult_12 = RoundToMultiple(N=expression_8, M="25")  # -> R; inputs N: tree, M: tree; same code as roundmult
roundmult_13 = RoundToMultiple(N=expression_3, M="0.05")  # -> R; inputs N: tree, M: tree; same code as roundmult
roundmult_14 = RoundToMultiple(N=expression_9, M="5")  # -> R; inputs N: tree, M: tree; same code as roundmult
effective_floor_area_m² = Number(roundmult_8)
specific_operational_global_warming_pote = Number(roundmult_9)  # "Specific Operational Global Warming Potential [kgCO2e/m²a]"
construction_cost_mio = Number(roundmult_10)
return_a = Number(roundmult_11)
construction_global_warming_potential_tc = Number(roundmult_12)  # "Construction Global Warming Potential [tCO2e]"
operational_cost_mio_a = Number(roundmult_13)
operational_global_warming_potential_tco = Number(roundmult_14)  # "Operational Global Warming Potential [tCO2e/a]"
income_mio_a = Number(roundmult)
maintenance_expenses_mio_a = Number(roundmult_2)
specific_energy_demand_kwh_m²a = Number(roundmult_3)
operational_energy_cost_a = Number(roundmult_4)
heating_energy_demand_mwh_a = Number(roundmult_5)
cooling_energy_demand_mwh_a = Number(roundmult_6)
technical_equipment_energy_demand_mwh_a = Number(roundmult_7)

mime = Mime({".stl": "model/stl", ".obj": "model/obj", ".glb": "model/gltf-binary", ".gltf": "model/gltf+json", ".3dm": "model/vnd.3dm", ".speckle": "model/vnd.speckle+json", ".png": "image/png", ".jpg": "image/jpeg", ".jpeg": "image/jpeg", ".svg": "image/svg+xml", ".pdf": "application/pdf", ".zip": "application/zip", ".json": "application/json", ".csv": "text/csv", ".txt": "text/plain"}, selected=".3dm")
list = ValueList({"1to500", "1to200"}, selected="1to500")
panel_3 = Panel("collider")
zoom = Button()
dsn_9 = ShowDesign(dn=prf.dn_3, ty=ty, O=objects, mm=mime, tags=list)  # -> O_4, id_2, rp_2, pln_2
bbox = BoundingBox(Content=flatten(dsn_9.O_4), Plane=PlaneXY(0, 0, 0), UnionBox=True)  # -> Box, Box_2
zoom2bb = ZoomToBoundingBox(N=["Top", "Front", "Right", "Perspective", "Parallel"], BB=bbox.Box, S=0, R=zoom)  # -> F, SBB; inputs BB: Box, R: Boolean
# ---------- zoom2bb: Python ----------
#Component Information
#--------------------------------------------------------------------------------------------
if ghenv.Component.RunCount<2:
    #General
    #--------------------------------------------------------------------------------------------
    __author__ = "Ueli Saluz"
    __version__ = "2022.05.21"
    
    ghenv.Component.Name = "ZoomToBoundingBox"
    ghenv.Component.NickName = "Zoom2BB"
    ghenv.Component.Description = "Zoom the view of a Rhino viewport to a bounding box."
    ghenv.Component.Message = "VER 1.1"
    ghenv.Component.Category = "Display"
    ghenv.Component.SubCategory = "Camera"
    
     #Inputs
    #--------------------------------------------------------------------------------------------
    inputIndex=0
    
    ghenv.Component.Params.Input[inputIndex].Name = "Name"
    ghenv.Component.Params.Input[inputIndex].NickName = "N"
    ghenv.Component.Params.Input[inputIndex].Description = "Name of the viewport"
    ghenv.Component.Params.Input[inputIndex].Optional = False
    inputIndex+=1
    
    ghenv.Component.Params.Input[inputIndex].Name = "BoundingBox"
    ghenv.Component.Params.Input[inputIndex].NickName = "BB"
    ghenv.Component.Params.Input[inputIndex].Description = ""
    ghenv.Component.Params.Input[inputIndex].Optional = False
    inputIndex+=1
    
    ghenv.Component.Params.Input[inputIndex].Name = "ScaleFactor"
    ghenv.Component.Params.Input[inputIndex].NickName = "S"
    ghenv.Component.Params.Input[inputIndex].Description = "A factor for the extension of the bounding box." \
    +"0 means 0 extension, a positive number makes the bounding box larger a negative smaller. The amount is proportional to the length."
    ghenv.Component.Params.Input[inputIndex].Optional = False
    inputIndex+=1
   
    
    ghenv.Component.Params.Input[inputIndex].Name = "Run"
    ghenv.Component.Params.Input[inputIndex].NickName = "R"
    ghenv.Component.Params.Input[inputIndex].Description = "Zoom to the given bounding box."
    ghenv.Component.Params.Input[inputIndex].Optional = False
    inputIndex+=1
    
    #Outputs
    #--------------------------------------------------------------------------------------------
    outputIndex=0
    
    ghenv.Component.Params.Output[outputIndex].Name = "Finished"
    ghenv.Component.Params.Output[outputIndex].NickName = "F"
    ghenv.Component.Params.Output[outputIndex].Description = "Sends True when finished. Just to trigger other depending components."
    outputIndex+=1
    
    ghenv.Component.Params.Output[outputIndex].Name = "ScaledBoundingBox"
    ghenv.Component.Params.Output[outputIndex].NickName = "SBB"
    ghenv.Component.Params.Output[outputIndex].Description = "The scaled bounding box."
    outputIndex+=1


#Imports
#--------------------------------------------------------------------------------------------
from Rhino import RhinoDoc
from Rhino.Geometry import Box

#Solver - Run with trees to enhance performance drastically
#--------------------------------------------------------------------------------------------
if __name__ == "__main__":
    try:
        vp = RhinoDoc.ActiveDoc.Views.Find(N, False).ActiveViewport
        if R:
            box = BB
            bb = BB.BoundingBox
            bb.Inflate(S*box.X.Length,S*box.Y.Length,S*box.Z.Length)
            vp.ZoomBoundingBox(bb)
            SBB = bb
        F = True
    except:
        pass
# ---------- end zoom2bb ----------
geo = PreviewGeometry(geo=dsn_9.O_4)

dn_2 = Design(prf.dn_3)
dn_3 = Design("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")
dsn_10 = SerializeDesign(Design=dn_3)

return_a_2 = Panel(return_a)
operational_cost_mio_a_2 = Panel(operational_cost_mio_a)
maintenance_expenses_mio_a_2 = Panel(maintenance_expenses_mio_a)
effective_floor_area_m²_2 = Panel(effective_floor_area_m²)
construction_cost_mio_2 = Panel(construction_cost_mio)
income_mio_a_2 = Panel(income_mio_a)
operational_energy_cost_a_2 = Panel(operational_energy_cost_a)
operational_global_warming_potential_tco_2 = Panel(operational_global_warming_potential_tco)  # "Operational Global Warming Potential [tCO2e/a]"
technical_equipment_energy_demand_mwh_a_2 = Panel(technical_equipment_energy_demand_mwh_a)
specific_operational_global_warming_pote_2 = Panel(specific_operational_global_warming_pote)  # "Specific Operational Global Warming Potential [kgCO2e/m²a]"
construction_global_warming_potential_tc_2 = Panel(construction_global_warming_potential_tc)  # "Construction Global Warming Potential [tCO2e]"
specific_energy_demand_kwh_m²a_2 = Panel(specific_energy_demand_kwh_m²a)
heating_energy_demand_mwh_a_2 = Panel(heating_energy_demand_mwh_a)
cooling_energy_demand_mwh_a_2 = Panel(cooling_energy_demand_mwh_a)

# ----
# Save the new design
save = BooleanToggle(False)
dsn_11 = PutDesign(Design=prf.dn_3, Uri=par, Run=save)

txt = EncodeText(Text=dsn_10, Mode=0)
context_bake = ContextBake(Content=txt)

# ==== cluster SelectDesign: Select a design with a name, an optional variant and an optional view. If no variant is provided it will select all variants. If you want to select the default variant then use the empty text. If no view is provided it will select all views. If you want to select the default view then use the empty text.
dn = ClusterInput()
na = ClusterInput()
variant = ClusterInput()
view = ClusterInput()
dn_2 = Design(dn)
na_2 = Name(na)
variant_2 = Variant(variant)
view_2 = View(view)
dsn = ModelDesign(Design=dn_2)  # -> Design, Valid, Name, Description, Icon, Image, Variant, View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
expression = Expression(x=dsn.Name, y=na_2, Expression="x=y")
cull = CullPattern(List=dsn.Design, CullPattern=expression)
dsn_2 = ModelDesign(Design=cull)  # -> Design, Valid, Name, Description, Icon, Image, Variant, View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
expression_2 = Expression(x=dsn_2.Variant, y=variant_2, Expression="x=y")
null = NullItem(Item=view_2)  # -> NullFlags, InvalidFlags, Description
cull_2 = CullPattern(List=cull, CullPattern=expression_2)
dsn_3 = ModelDesign(Design=cull_2)  # -> Design, Valid, Name, Description, Icon, Image, Variant, View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
expression_3 = Expression(x=dsn_3.View, y=view_2, Expression="x=y")
cull_3 = CullPattern(List=cull_2, CullPattern=expression_3)
filter = StreamFilter(Gate=null.NullFlags, Stream0=cull_3, Stream1=cull_2)
null_2 = NullItem(Item=variant_2)  # -> NullFlags, InvalidFlags, Description
filter_2 = StreamFilter(Gate=null_2.NullFlags, Stream0=filter, Stream1=cull)
dn_3 = Design(filter_2)
dn_4 = ClusterOutput(dn_3)

# ==== cluster CacheKit: Cache a kit by downloading the remote kit with all remote representations.
uri = ClusterInput()
R = ClusterInput()
R_2 = Run(R)
uri_2 = Uri(uri)
kit = LoadKit(Uri=uri_2, Run=R_2)  # -> Success, Kit, LocalDirectory
sep = Separator()  # -> S
# ---------- sep: C# ----------
#region Usings
using System;
using System.Linq;
using System.Collections;
using System.Collections.Generic;
using System.Drawing;
using System.IO;

using Rhino;
using Rhino.Geometry;

using Grasshopper;
using Grasshopper.Kernel;
using Grasshopper.Kernel.Data;
using Grasshopper.Kernel.Types;
#endregion

public class Script_Instance : GH_ScriptInstance
{
    private void RunScript(ref object S)
    {
        S = Path.DirectorySeparatorChar;
    }
}
# ---------- end sep ----------
kit_2 = ModelKit(Kit=kit.Kit)  # -> Kit, Valid, Name, Description, Icon, Image, Preview, Version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
trim = TrimTree(Tree=kit_2.Types, Depth=1)
trim_2 = TrimTree(Tree=kit_2.Designs, Depth=1)
typ = ModelType(Type=trim)  # -> Type, Valid, Name, Description, Icon, Image, Variant, Unit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
rep = ModelRepresentation(Representation=typ.Representations)  # -> Representation, Valid, Url, Mime, Tags, Tags_2, Qualities
tmatch = MatchText(Text=rep.Url, Pattern="http*", Case=True)
dispatch = Dispatch(List=rep.Url, DispatchPattern=tmatch)  # -> ListA, ListB
rep_2 = ReplaceText(Text=dispatch.ListB, Find="/", Replace=sep, RecursiveReplace=False)
rep_3 = CacheRepresentation(Url=dispatch.ListA, Run=R_2)  # -> Path, Success
concat = Concatenate(FragmentA=kit.LocalDirectory, FragmentB=sep, FragmentC=rep_2)
weave = Weave(Pattern=tmatch, Stream0=concat, Stream1=rep_3.Path, NullGaps=False)
import = ImportContent(FilePath=weave, Import=R_2)  # -> ModelTransform, Objects, Layers, Linetypes, HatchPatterns, AnnotationStyles, Materials, BlockDefinitions
ty = Type(trim)
urpa = Url(weave)
urpare = Url(rep_3.Path)
kt = Kit(kit.Kit)
dn = Design()
rp = Representation(typ.Representations)
ur = Url(rep.Url)
objects = Data(import.Objects)
urpalc = Url(concat)
kt_2 = ClusterOutput(kt)
ty_2 = ClusterOutput(ty)
dn_2 = ClusterOutput(dn)
ur_2 = ClusterOutput(ur)
objects_2 = ClusterOutput(objects)
urpa_2 = ClusterOutput(urpa)
urpalc_2 = ClusterOutput(urpalc)
urpare_2 = ClusterOutput(urpare)
rp_2 = ClusterOutput(rp)

# ==== cluster PreviewGeometry: semio styled preview of geometry.
geo = ClusterInput()
swatch = ColourSwatch(SwatchColor=RGB(255, 255, 255))
swatch_2 = ColourSwatch(SwatchColor=RGB(0, 0, 0))
geo_2 = Geometry(flatten(geo))
dispatch = CSharpScript(D=geo_2)  # -> P, C, B, M, R
# ---------- dispatch: C# ----------
// Grasshopper Script Instance
#region Usings
using System;
using System.Linq;
using System.Collections;
using System.Collections.Generic;
using System.Drawing;

using Rhino;
using Rhino.Geometry;

using Grasshopper;
using Grasshopper.Kernel;
using Grasshopper.Kernel.Data;
using Grasshopper.Kernel.Types;
#endregion

public class Script_Instance : GH_ScriptInstance
{
    #region Notes
    /* 
      Members:
        RhinoDoc RhinoDocument
        GH_Document GrasshopperDocument
        IGH_Component Component
        int Iteration

      Methods (Virtual & overridable):
        Print(string text)
        Print(string format, params object[] args)
        Reflect(object obj)
        Reflect(object obj, string method_name)
    */
    #endregion

    private void RunScript(
	object D,
	ref object P,
	ref object C,
	ref object B,
	ref object M,
	ref object R)
    {
        if (D is Curve) C = D; // Curve
        else if (
            D is Rhino.Geometry.Point ||
            D is PointCloud
            )
            P = D; // Point
        else if ( D is Mesh) M = D; // Mesh
        else if (
            D is Surface ||
            D is Extrusion ||
            D is SubD ||
            D is Brep
            )
            B = D; // Brep
        else R = D; // Rest
            
    }
}
# ---------- end dispatch ----------
clean = CleanTree(RemoveNulls=True, RemoveInvalid=True, RemoveEmpty=False, Tree=dispatch.P)
clean_2 = CleanTree(RemoveNulls=True, RemoveInvalid=True, RemoveEmpty=False, Tree=dispatch.C)
clean_3 = CleanTree(RemoveNulls=True, RemoveInvalid=True, RemoveEmpty=False, Tree=dispatch.B)
clean_4 = CleanTree(RemoveNulls=True, RemoveInvalid=True, RemoveEmpty=False, Tree=dispatch.M)
clean_5 = CleanTree(RemoveNulls=True, RemoveInvalid=True, RemoveEmpty=False, Tree=dispatch.R)
debrep = DeconstructBrep(Brep=clean_3)  # -> Faces, Edges, Vertices
preview = CustomPreview(Geometry=flatten(clean_5), Material=swatch_2)
preview_2 = CustomPreview(Geometry=flatten(clean), Material=swatch_2)
preview_3 = CustomPreview(Geometry=flatten(clean_2), Material=swatch_2)
preview_4 = CustomPreview(Geometry=flatten(debrep.Faces), Material=swatch)
preview_5 = CustomPreview(Geometry=flatten(debrep.Edges), Material=swatch_2)
preview_6 = CustomPreview(Geometry=flatten(clean_4), Material=swatch)

# ==== cluster MoveDesign: Move (translate and rotate) the design by moving all planes and centers.
ce = ClusterInput()
dn = ClusterInput()
pn = ClusterInput()
dn_2 = Design(dn)
pn_2 = Transform(pn)
ce_2 = Transform(ce)
dsn = ModelDesign(Design=dn_2)  # -> Design, Valid, Name, Description, Icon, Image, Variant, View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
trim = TrimTree(Tree=dsn.Pieces, Depth=1)
pce = ModelPiece(Piece=trim)  # -> Piece, Valid, Id, Description, TypeName, TypeVariant, Plane, Center, Qualities
pt = Point(pce.Center)
pt_2 = Point(ce_2)
transform = Transform(Geometry=pce.Plane, Transform=pn_2)
transform_2 = Transform(Geometry=pt, Transform=pt_2)
pce_2 = ModelPiece(Piece=pce.Piece, Plane=transform, Center=transform_2)  # -> Piece, Valid, Id, Description, TypeName, TypeVariant, Plane, Center, Qualities
dsn_2 = ModelDesign(Design=dsn.Design, Pieces=pce_2.Piece)  # -> Design, Valid, Name, Description, Icon, Image, Variant, View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
dn_3 = Design(dsn_2.Design)
dn_4 = ClusterOutput(dn_3)

# ==== cluster InterpolateDesigns: Interpolate between a source design and a target design. The target will act as a blueprint. The result is an interpolated union design and two unmodified but filtered difference design. Piece planes and connection values are linearly interpolated.
T = ClusterInput()
S = ClusterInput()
t = ClusterInput()
T_2 = Design(T)
S_2 = Design(S)
t_2 = Number(t)
dsn = NormalizeDesign(dn=T_2)
dsn_2 = NormalizeDesign(dn=S_2)
dsn_3 = ModelDesign(Design=dsn_2)  # -> Design, Valid, Name, Description, Icon, Image, Variant, View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
dsn_4 = ModelDesign(Design=dsn)  # -> Design, Valid, Name, Description, Icon, Image, Variant, View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
trim = TrimTree(Tree=dsn_3.Pieces, Depth=1)
trim_2 = TrimTree(Tree=dsn_3.Connections, Depth=1)
trim_3 = TrimTree(Tree=dsn_4.Pieces, Depth=1)
trim_4 = TrimTree(Tree=dsn_4.Connections, Depth=1)
pce = ModelPiece(Piece=trim)  # -> Piece, Valid, Id, Description, TypeName, TypeVariant, Plane, Center, Qualities
pce_2 = ModelPiece(Piece=trim_3)  # -> Piece, Valid, Id, Description, TypeName, TypeVariant, Plane, Center, Qualities
con = ModelConnection(Connection=trim_4)  # -> Connection, Valid, ConnectedPieceId, ConnectedPieceTypePortId, ConnectingPieceId, ConnectingPieceTypePortId, Description, Gap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
con_2 = ModelConnection(Connection=trim_2)  # -> Connection, Valid, ConnectedPieceId, ConnectedPieceTypePortId, ConnectingPieceId, ConnectingPieceTypePortId, Description, Gap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
intersection = SetIntersection(SetA=pce.Id, SetB=pce_2.Id)
difference = SetDifference(SetA=pce.Id, SetB=pce_2.Id)
difference_2 = SetDifference(SetA=pce_2.Id, SetB=pce.Id)
con_3 = SelectConnection(co=trim_4, cdpc=con_2.ConnectedPieceId, cgpc=con_2.ConnectingPieceId)  # -> co_4, i_2, fl_2
con_4 = SelectConnection(co=trim_2, cdpc=con.ConnectedPieceId, cgpc=con.ConnectingPieceId)  # -> co_4, i_2, fl_2
pce_3 = SelectPiece(pc=pce.Piece, id=difference)  # -> pc_4, i_2
pce_4 = SelectPiece(pc=pce.Piece, id=intersection)  # -> pc_4, i_2
pce_5 = SelectPiece(pc=pce_2.Piece, id=intersection)  # -> pc_4, i_2
pce_6 = SelectPiece(pc=pce_2.Piece, id=difference_2)  # -> pc_4, i_2
expression = Expression(x=t_2, Expression="1-x")
con_5 = ModelConnection(Connection=con_4.co_4)  # -> Connection, Valid, ConnectedPieceId, ConnectedPieceTypePortId, ConnectingPieceId, ConnectingPieceTypePortId, Description, Gap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
con_6 = ModelConnection(Connection=con_3.co_4)  # -> Connection, Valid, ConnectedPieceId, ConnectedPieceTypePortId, ConnectingPieceId, ConnectingPieceTypePortId, Description, Gap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
pce_7 = ModelPiece(Piece=pce_4.pc_4)  # -> Piece, Valid, Id, Description, TypeName, TypeVariant, Plane, Center, Qualities
pce_8 = ModelPiece(Piece=pce_5.pc_4)  # -> Piece, Valid, Id, Description, TypeName, TypeVariant, Plane, Center, Qualities
merge = Merge(Data1=expression, Data2=t_2)
expression_2 = Expression(x=con_5.Rotation, y=con_6.Rotation, Expression="If(Abs(x-y)≤180,y,-(360-y))")
expression_3 = Expression(x=con_5.Tilt, y=con_6.Tilt, Expression="If(Abs(x-y)≤180,y,-(360-y))")
merge_2 = Merge(Data1=graft(pce_7.Plane), Data2=graft(pce_8.Plane))
merge_3 = Merge(Data1=graft(con_5.Gap), Data2=graft(con_6.Gap))
merge_4 = Merge(Data1=graft(con_5.Shift), Data2=graft(con_6.Shift))
merge_5 = Merge(Data1=graft(con_5.Tilt), Data2=graft(expression_3))
merge_6 = Merge(Data1=graft(con_5.Rotation), Data2=graft(expression_2))
tstat = TreeStatistics(Tree=con_4.co_4)  # -> Paths, Length, Count
tstat_2 = TreeStatistics(Tree=con_3.co_4)  # -> Paths, Length, Count
concat = Concatenate(FragmentA=dsn_3.Name, FragmentE=",", FragmentF=dsn_3.Variant)
concat_2 = Concatenate(FragmentA=dsn_4.Name, FragmentE=",", FragmentF=dsn_4.Variant)
expression_4 = Expression(x=t_2, Expression="x≥0.5")
avgpl = AveragePlane(Pl=merge_2, M=merge)  # -> AvPl; inputs Pl: list of Plane, M: list of Double
# ---------- avgpl: C# usings ----------
using System.Linq;
# ---------- avgpl: C# ----------
    //Author: Ueli Saluz
    //Last modified: 29.05.2020
    //Contact: usaluz@outlook.de

    if (Component.RunCount < 2)
    {
      Component.Name = "AveragePlane";
      Component.NickName = "AvgPl";
      Component.Description = "Get the average plane from a set of planes. Provide multiplier to weight some planes more.";

      Component.Params.Input[0].Name = "Planes";
      Component.Params.Input[0].Description = "Planes to take average from.";
      Component.Params.Input[1].Name = "weights";
      Component.Params.Input[1].Description = "weights act like weights towards a plane.";

      Component.Params.Output[0].Name = "AveragePlane";
      Component.Params.Output[0].Description = "Resulting average plane.";

      Component.Message = "VER 1.0";
    }
    AvPl = GetAveragePlane(Pl.ToArray(), M.ToArray());
# ---------- avgpl: C# additional code ----------
  /// <summary>
  /// Gets the average plane from a set of of planes. Each plane can have a weight.
  /// </summary>
  /// <param name="planes"></param>
  /// <param name="weights"></param>
  /// <returns>Average plane under consideration of weights</returns>
  public Plane GetAveragePlane(Plane[] planes, double[] weights)
  {
    //If there are less weights than planes then the weight of 1 is assumed.
    if (weights.Length < planes.Length)
      weights = weights.Concat(Enumerable.Repeat(1d, planes.Length - weights.Length)).ToArray();
    //If there are more weights than planes then the last ones will be ignored.
    else if (weights.Length > planes.Length)
      weights = weights.Take(planes.Length).ToArray();

    if (weights.Sum() == 0)
      weights = Enumerable.Repeat(1d, planes.Length).ToArray();

    var sum = weights.Sum();
    weights = weights.Select(x => x / sum).ToArray();

    var origins = planes.Select(x => x.Origin).ToArray();
    var xAxes = planes.Select(x => x.XAxis).ToArray();
    var yAxes = planes.Select(x => x.YAxis).ToArray();

    for (int i = 0; i < planes.Length; i++)
    {
      origins[i].Transform(new Transform(weights[i]));
      xAxes[i].Transform(new Transform(weights[i]));
      yAxes[i].Transform(new Transform(weights[i]));
    }

    return new Plane(origins.Aggregate((a,b) => a + b), xAxes.Aggregate((a,b) => a + b), yAxes.Aggregate((a,b) => a + b));
  }
# ---------- end avgpl ----------
interp = InterpolateData(Data=merge_6, Parameter=t_2, Interpolation=2)
interp_2 = InterpolateData(Data=merge_3, Parameter=t_2, Interpolation=2)
interp_3 = InterpolateData(Data=merge_4, Parameter=t_2, Interpolation=2)
interp_4 = InterpolateData(Data=merge_5, Parameter=t_2, Interpolation=2)
concat_3 = Concatenate(FragmentD=")")
concat_4 = Concatenate(FragmentA=concat_2, FragmentB="(", FragmentD=")")
c_script = CSharpScript(x=avgpl)  # -> a; inputs x: Plane
# ---------- c_script: C# ----------
// Grasshopper Script Instance
#region Usings
using System;
using System.Linq;
using System.Collections;
using System.Collections.Generic;
using System.Drawing;

using Rhino;
using Rhino.Geometry;

using Grasshopper;
using Grasshopper.Kernel;
using Grasshopper.Kernel.Data;
using Grasshopper.Kernel.Types;
#endregion

public class Script_Instance : GH_ScriptInstance
{
    #region Notes
    /* 
      Members:
        RhinoDoc RhinoDocument
        GH_Document GrasshopperDocument
        IGH_Component Component
        int Iteration

      Methods (Virtual & overridable):
        Print(string text)
        Print(string format, params object[] args)
        Reflect(object obj)
        Reflect(object obj, string method_name)
    */
    #endregion

    private void RunScript(Plane x, ref object a)
    {
        a = x.IsValid ? x : null;
    }
}
# ---------- end c_script ----------
filter = StreamFilter(Gate=expression_4, Stream0=con_5.Connection, Stream1=con_6.Connection)
equals = Equality(FirstNumber=tstat.Length, SecondNumber="0")  # -> Equality, Inequality
equals_2 = Equality(FirstNumber=tstat_2.Length, SecondNumber="0")  # -> Equality, Inequality
trim_5 = TrimTree(Tree=interp, Depth=1)
trim_6 = TrimTree(Tree=interp_4, Depth=1)
trim_7 = TrimTree(Tree=interp_2, Depth=1)
trim_8 = TrimTree(Tree=interp_3, Depth=1)
filter_2 = StreamFilter(Gate=expression_4, Stream0=pce_7.Piece, Stream1=pce_8.Piece)
concat_5 = Concatenate(FragmentA=concat, FragmentB=" U ", FragmentC=concat_2)
concat_6 = Concatenate(FragmentA=concat, FragmentB=" \ ", FragmentC=concat_2)
concat_7 = Concatenate(FragmentA=concat, FragmentB=" \ ", FragmentC=concat_2)
trim_9 = TrimTree(Tree=c_script, Depth=1)
cull = CullPattern(List=trim_2, CullPattern=equals_2.Equality)
cull_2 = CullPattern(List=trim_4, CullPattern=equals.Equality)
con_7 = ModelConnection(Connection=filter, Gap=trim_7, Shift=trim_8, Rotation=trim_5, Tilt=trim_6)  # -> Connection, Valid, ConnectedPieceId, ConnectedPieceTypePortId, ConnectingPieceId, ConnectingPieceTypePortId, Description, Gap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
concat_8 = Concatenate(FragmentA=t_2, FragmentB=",", FragmentC=expression)
pce_9 = ModelPiece(Piece=filter_2, Plane=trim_9)  # -> Piece, Valid, Id, Description, TypeName, TypeVariant, Plane, Center, Qualities
pc_s_u_t = Piece(pce_9.Piece)
pc_s_t = Piece(pce_3.pc_4)
pc_t_s = Piece(pce_6.pc_4)
co_s_u_t = Connection(con_7.Connection)
co_s_t = Connection(cull)
co_t_s = Connection(cull_2)
dsn_5 = ModelDesign(Name=concat_6, Pieces=pc_s_t, Connections=co_s_t)  # -> Design, Valid, Name, Description, Icon, Image, Variant, View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
dsn_6 = ModelDesign(Name=concat_5, Variant=concat_8, Pieces=pc_s_u_t, Connections=co_s_u_t)  # -> Design, Valid, Name, Description, Icon, Image, Variant, View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
dsn_7 = ModelDesign(Name=concat_7, Pieces=pc_t_s, Connections=co_t_s)  # -> Design, Valid, Name, Description, Icon, Image, Variant, View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
dn_s_u_t = Design(dsn_6.Design)
dn_s_t = Design(dsn_5.Design)
dn_t_s = Design(dsn_7.Design)
dn_t_s_2 = ClusterOutput(dn_t_s)
dn_s_t_2 = ClusterOutput(dn_s_t)
dn_s_u_t_2 = ClusterOutput(dn_s_u_t)

# ==== cluster MergeDesigns: Merge a list of distinct designs into a new design. All designs are normalized first, so the connections align. All the pieces have the name and variant as a prefix to ensure uniqueness. Make sure every design is distinct by having a unique combination of name and variant.
dn = ClusterInput()
na = ClusterInput()
description = ClusterInput()
icon = ClusterInput()
image = ClusterInput()
variant = ClusterInput()
view = ClusterInput()
qualities = ClusterInput()
authors = ClusterInput()
na_2 = Name(na)
description_2 = Description(description)
icon_2 = Icon(icon)
image_2 = Image(image)
variant_2 = Variant(variant)
view_2 = View(view)
qualities_2 = Qualities(qualities)
authors_2 = Authors(authors)
dn_2 = Design(dn)
dsn = NormalizeDesign(dn=dn_2)
dsn_2 = ModelDesign(Design=dsn)  # -> Design, Valid, Name, Description, Icon, Image, Variant, View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
con = ModelConnection(Connection=dsn_2.Connections)  # -> Connection, Valid, ConnectedPieceId, ConnectedPieceTypePortId, ConnectingPieceId, ConnectingPieceTypePortId, Description, Gap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
pce = ModelPiece(Piece=dsn_2.Pieces)  # -> Piece, Valid, Id, Description, TypeName, TypeVariant, Plane, Center, Qualities
concat = Concatenate(FragmentA=dsn_2.Name, FragmentB=",", FragmentC=dsn_2.Variant, FragmentD=",", FragmentE=dsn_2.View)
concat_2 = Concatenate(FragmentC=graft(concat), FragmentA=",", FragmentB=pce.Id)
concat_3 = Concatenate(FragmentC=graft(concat), FragmentA=",", FragmentB=con.ConnectedPieceId)
concat_4 = Concatenate(FragmentC=graft(concat), FragmentA=",", FragmentB=con.ConnectingPieceId)
con_2 = ModelConnection(Connection=con.Connection, ConnectedPieceId=concat_3, ConnectingPieceId=concat_4)  # -> Connection, Valid, ConnectedPieceId, ConnectedPieceTypePortId, ConnectingPieceId, ConnectingPieceTypePortId, Description, Gap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
pce_2 = ModelPiece(Piece=pce.Piece, Id=concat_2)  # -> Piece, Valid, Id, Description, TypeName, TypeVariant, Plane, Center, Qualities
trim = TrimTree(Tree=con_2.Connection, Depth=1)
trim_2 = TrimTree(Tree=pce_2.Piece, Depth=1)
dsn_3 = ModelDesign(
    Name=na_2,
    Description=description_2,
    Icon=icon_2,
    Image=image_2,
    Variant=variant_2,
    View=view_2,
    Pieces=trim_2,
    Connections=trim,
    Authors=authors_2,
    Qualities=qualities_2)  # -> Design, Valid, Name, Description, Icon, Image, Variant, View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
dn_3 = Design(dsn_3.Design)
dn_4 = ClusterOutput(dn_3)

# ==== cluster AssessPerformance: Simple performance assement based on the following qualities of the types (No unit conversion is applied for now, so make sure that all your types have the values with the same unit.): floor area, effective floor area, residents, workspaces, construction cost, maintenance expenses, income, transmission heat loss, ventilation heat loss, cooling energy demand, technical equipment energy demand,construction global warming potential, heating load, cooling load, ventilation air flow volume
dn = ClusterInput()
ty = ClusterInput()
technical_equipment_cost = ClusterInput()
technical_equipment_gwp_kgco2e = ClusterInput()
ventilation_heat_recovery_factor = ClusterInput()
heating_efficiency_factor = ClusterInput()
heating_primary_energy_factor = ClusterInput()
heating_energy_price_kwh = ClusterInput()
heating_global_warming_potential_kgco2e = ClusterInput()  # "Heating Global Warming Potential [kgCO2e/kWh]"
cooling_efficiency_factor = ClusterInput()
cooling_primary_energy_factor = ClusterInput()
cooling_global_warming_potential_kgco2e = ClusterInput()  # "Cooling Global Warming Potential [kgCO2e/kWh]"
cooling_energy_price_kwh = ClusterInput()
electrictiy_primary_energy_factor = ClusterInput()
electrictiy_global_warming_potential_kgc = ClusterInput()  # "Electrictiy Global Warming Potential [kgCO2e/kWh]"
electrictiy_energy_price_kwh = ClusterInput()
co2_price_tco2e = ClusterInput()
life_cycle_a = ClusterInput()
electrictiy_energy_price_kwh_2 = Number(electrictiy_energy_price_kwh)
heating_primary_energy_factor_2 = Number(heating_primary_energy_factor)
heating_energy_price_kwh_2 = Number(heating_energy_price_kwh)
heating_global_warming_potential_kgco2e_2 = Number(heating_global_warming_potential_kgco2e)  # "Heating Global Warming Potential [kgCO2e/kWh]"
cooling_energy_price_kwh_2 = Number(cooling_energy_price_kwh)
electrictiy_primary_energy_factor_2 = Number(electrictiy_primary_energy_factor)
ventilation_heat_recovery_factor_2 = Number(ventilation_heat_recovery_factor)
heating_efficiency_factor_2 = Number(heating_efficiency_factor)
cooling_efficiency_factor_2 = Number(cooling_efficiency_factor)
cooling_primary_energy_factor_2 = Number(cooling_primary_energy_factor)
cooling_global_warming_potential_kgco2e_2 = Number(cooling_global_warming_potential_kgco2e)  # "Cooling Global Warming Potential [kgCO2e/kWh]"
electrictiy_global_warming_potential_kgc_2 = Number(electrictiy_global_warming_potential_kgc)  # "Electrictiy Global Warming Potential [kgCO2e/kWh]"
co2_price_tco2e_2 = Number(co2_price_tco2e)
life_cycle_a_2 = Number(life_cycle_a)
dn_2 = Design(dn)
ty_2 = Type(ty)
technical_equipment_cost_2 = Number(technical_equipment_cost)
technical_equipment_gwp_kgco2e_2 = Number(technical_equipment_gwp_kgco2e)
expression = Expression(x=co2_price_tco2e_2, Expression="x/1000")
co2_price_kgco2e = Number(expression)
sumqal = SumQualities(dn=dn_2, ty=ty_2, na="floor area")  # -> num_2, ql_2
sumqal_2 = SumQualities(dn=dn_2, ty=ty_2, na="effective floor area")  # -> num_2, ql_2
sumqal_3 = SumQualities(dn=dn_2, ty=ty_2, na="residents")  # -> num_2, ql_2
sumqal_4 = SumQualities(dn=dn_2, ty=ty_2, na="workspaces")  # -> num_2, ql_2
sumqal_5 = SumQualities(dn=dn_2, ty=ty_2, na="construction cost")  # -> num_2, ql_2
sumqal_6 = SumQualities(dn=dn_2, ty=ty_2, na="maintenance expenses")  # -> num_2, ql_2
sumqal_7 = SumQualities(dn=dn_2, ty=ty_2, na="income")  # -> num_2, ql_2
sumqal_8 = SumQualities(dn=dn_2, ty=ty_2, na="transmission heat demand")  # -> num_2, ql_2
sumqal_9 = SumQualities(dn=dn_2, ty=ty_2, na="ventilation heat demand")  # -> num_2, ql_2
sumqal_10 = SumQualities(dn=dn_2, ty=ty_2, na="cooling energy demand")  # -> num_2, ql_2
sumqal_11 = SumQualities(dn=dn_2, ty=ty_2, na="technical equipment energy demand")  # -> num_2, ql_2
sumqal_12 = SumQualities(dn=dn_2, ty=ty_2, na="construction global warming potential")  # -> num_2, ql_2
sumqal_13 = SumQualities(dn=dn_2, ty=ty_2, na="heating load")  # -> num_2, ql_2
sumqal_14 = SumQualities(dn=dn_2, ty=ty_2, na="cooling load")  # -> num_2, ql_2
sumqal_15 = SumQualities(dn=dn_2, ty=ty_2, na="ventilation air flow volume")  # -> num_2, ql_2
addition = Addition(A=sumqal_3.num_2, B=sumqal_4.num_2)
ventilation_heat_recovery_factor_3 = Number(ventilation_heat_recovery_factor_2)
users_person = Number(addition)
ventiation_heat_loss_kwh_a = Number(sumqal_9.num_2)
transmission_heat_loss_kwh_a = Number(sumqal_8.num_2)
expression_2 = Expression(x=ventilation_heat_recovery_factor_3, Expression="1-x")
multiplication = Multiplication(A=ventiation_heat_loss_kwh_a, B=expression_2)
heating_global_warming_potential_kgco2e_3 = Number(heating_global_warming_potential_kgco2e_2)  # "Heating Global Warming Potential [kgCO2e/kWh]"
electrictiy_global_warming_potential_kgc_3 = Number(electrictiy_global_warming_potential_kgc_2)  # "Electrictiy Global Warming Potential [kgCO2e/kWh]"
cooling_global_warming_potential_kgco2e_3 = Number(cooling_global_warming_potential_kgco2e_2)  # "Cooling Global Warming Potential [kgCO2e/kWh]"
addition_2 = Addition(A=transmission_heat_loss_kwh_a, B=multiplication)
heating_energy_demand_kwh_a = Number(addition_2)
cooling_energy_demand_kwh_a = Number(sumqal_10.num_2)
heating_efficiency_factor_3 = Number(heating_efficiency_factor_2)
cooling_efficiency_factor_3 = Number(cooling_efficiency_factor_2)
technical_equipment_energy_demand_kwh_a = Number(sumqal_11.num_2)
electricity_energy_demand_kwh_a = Number(technical_equipment_energy_demand_kwh_a)
multiplication_2 = Multiplication(A=electricity_energy_demand_kwh_a, B=electrictiy_global_warming_potential_kgc_3)
multiplication_3 = Multiplication(A=heating_energy_demand_kwh_a, B=heating_efficiency_factor_3)
final_heating_energy_demand_kwh_a = Number(multiplication_3)
multiplication_4 = Multiplication(A=final_heating_energy_demand_kwh_a, B=heating_global_warming_potential_kgco2e_3)
multiplication_5 = Multiplication(A=cooling_energy_demand_kwh_a, B=cooling_efficiency_factor_3)
final_cooling_energy_demand_kwh_a = Number(multiplication_5)
multiplication_6 = Multiplication(A=final_cooling_energy_demand_kwh_a, B=cooling_global_warming_potential_kgco2e_3)
heating_global_warming_potential_kgco2e_4 = Number(multiplication_4)  # "Heating Global Warming Potential [kgCO2e/a]"
cooling_global_warming_potential_kgco2e_4 = Number(multiplication_6)  # "Cooling Global Warming Potential [kgCO2e/a]"
electricity_global_warming_potential_kgc = Number(multiplication_2)  # "Electricity Global Warming Potential [kgCO2e/a]"
final_heating_energy_demand_kwh_a_2 = Number(multiplication_3)
final_cooling_energy_demand_kwh_a_2 = Number(multiplication_5)
electricity_energy_demand_kwh_a_2 = Number(technical_equipment_energy_demand_kwh_a)
electrictiy_energy_price_kwh_3 = Number(electrictiy_energy_price_kwh_2)
heating_energy_price_kwh_3 = Number(heating_energy_price_kwh_2)
cooling_energy_price_kwh_3 = Number(cooling_energy_price_kwh_2)
co2_price_kgco2e_2 = Number(co2_price_kgco2e)
co2_price_kgco2e_3 = Number(co2_price_kgco2e)
co2_price_kgco2e_4 = Number(co2_price_kgco2e)
multiplication_7 = Multiplication(A=final_heating_energy_demand_kwh_a_2, B=heating_energy_price_kwh_3)
multiplication_8 = Multiplication(A=electricity_energy_demand_kwh_a_2, B=electrictiy_energy_price_kwh_3)
multiplication_9 = Multiplication(A=final_cooling_energy_demand_kwh_a_2, B=cooling_energy_price_kwh_3)
multiplication_10 = Multiplication(A=heating_global_warming_potential_kgco2e_4, B=co2_price_kgco2e_2)
multiplication_11 = Multiplication(A=cooling_global_warming_potential_kgco2e_4, B=co2_price_kgco2e_3)
multiplication_12 = Multiplication(A=electricity_global_warming_potential_kgc, B=co2_price_kgco2e_4)
electricity_global_warming_potential_kgc_2 = Number(electricity_global_warming_potential_kgc)  # "Electricity Global Warming Potential [kgCO2e/a]"
heating_global_warming_potential_kgco2e_5 = Number(heating_global_warming_potential_kgco2e_4)  # "Heating Global Warming Potential [kgCO2e/a]"
cooling_global_warming_potential_kgco2e_5 = Number(cooling_global_warming_potential_kgco2e_4)  # "Cooling Global Warming Potential [kgCO2e/a]"
heating_energy_price_a = Number(multiplication_7)
cooling_energy_price_a = Number(multiplication_8)
heating_co2_price_a = Number(multiplication_10)
cooling_co2_price_a = Number(multiplication_11)
cooling_energy_price_a_2 = Number(multiplication_9)
electricity_co2_price_a = Number(multiplication_12)
final_heating_energy_demand_kwh_a_3 = Number(final_heating_energy_demand_kwh_a_2)
final_cooling_energy_demand_kwh_a_3 = Number(final_cooling_energy_demand_kwh_a_2)
electricity_energy_demand_kwh_a_3 = Number(electricity_energy_demand_kwh_a_2)
electricity_energy_demand_kwh_a_4 = Number(electricity_energy_demand_kwh_a_2)
electrictiy_primary_energy_factor_3 = Number(electrictiy_primary_energy_factor_2)
heating_primary_energy_factor_3 = Number(heating_primary_energy_factor_2)
final_cooling_energy_demand_kwh_a_4 = Number(final_cooling_energy_demand_kwh_a_2)
cooling_primary_energy_factor_3 = Number(cooling_primary_energy_factor_2)
final_heating_energy_demand_kwh_a_4 = Number(final_heating_energy_demand_kwh_a_2)
building_construction_gwp_kgco2e = Number(sumqal_12.num_2)
technical_equipment_gwp_kgco2e_3 = Number(technical_equipment_gwp_kgco2e_2)
addition_3 = Addition(A=cooling_energy_price_a_2, B=cooling_co2_price_a)
addition_4 = Addition(A=heating_energy_price_a, B=heating_co2_price_a)
addition_5 = Addition(A=cooling_energy_price_a, B=electricity_co2_price_a)
addition_6 = Addition(
    A=heating_global_warming_potential_kgco2e_5,
    B=cooling_global_warming_potential_kgco2e_5,
    C=electricity_global_warming_potential_kgc_2)
addition_7 = Addition(A=final_heating_energy_demand_kwh_a_3, B=final_cooling_energy_demand_kwh_a_3, C=electricity_energy_demand_kwh_a_4)
multiplication_13 = Multiplication(A=electricity_energy_demand_kwh_a_3, B=electrictiy_primary_energy_factor_3)
multiplication_14 = Multiplication(A=final_heating_energy_demand_kwh_a_4, B=heating_primary_energy_factor_3)
multiplication_15 = Multiplication(A=final_cooling_energy_demand_kwh_a_4, B=cooling_primary_energy_factor_3)
electricity_expenses_a = Number(addition_5)
heating_expenses_a = Number(addition_4)
cooling_expenses_a = Number(addition_3)
energy_global_warming_potential_kgco2e_a = Number(addition_6)
final_energy_demand_kwh_a = Number(addition_7)
primary_heating_energy_demand_kwh_a = Number(multiplication_14)
primary_cooling_energy_demand_kwh_a = Number(multiplication_15)
primary_electricity_energy_demand_kwh_a = Number(multiplication_13)
addition_8 = Addition(A=building_construction_gwp_kgco2e, B=technical_equipment_gwp_kgco2e_3)
addition_9 = Addition(A=heating_expenses_a, B=cooling_expenses_a, C=electricity_expenses_a)
life_cycle_a_3 = Number(life_cycle_a_2)
construction_gwp_kgco2e = Number(addition_8)
maintenance_expenses_a = Number(sumqal_6.num_2)
energy_expenses_a = Number(addition_9)
multiplication_16 = Multiplication(A=energy_global_warming_potential_kgco2e_a, B=life_cycle_a_3)
addition_10 = Addition(A=primary_heating_energy_demand_kwh_a, B=primary_cooling_energy_demand_kwh_a, C=primary_electricity_energy_demand_kwh_a)
addition_11 = Addition(A=multiplication_16, B=construction_gwp_kgco2e)
addition_12 = Addition(A=maintenance_expenses_a, B=energy_expenses_a)
primary_energy_demand_kwh_a = Number(addition_10)
building_construction_cost = Number(sumqal_5.num_2)
technical_equipment_cost_3 = Number(technical_equipment_cost_2)
life_cycle_gwp_kgco2e = Number(addition_11)
expenses_a = Number(addition_12)
life_cycle_a_4 = Number(life_cycle_a_2)
multiplication_17 = Multiplication(A=expenses_a, B=life_cycle_a_4)
addition_13 = Addition(A=building_construction_cost, B=technical_equipment_cost_3)
life_cycle_expenses = Number(multiplication_17)
construction_cost = Number(addition_13)
income_a = Number(sumqal_7.num_2)
life_cycle_a_5 = Number(life_cycle_a_2)
addition_14 = Addition(A=construction_cost, B=life_cycle_expenses)
multiplication_18 = Multiplication(A=income_a, B=life_cycle_a_5)
cooling_energy_demand_kwh_a_2 = Number(cooling_energy_demand_kwh_a)
heating_energy_demand_kwh_a_2 = Number(heating_energy_demand_kwh_a)
heating_energy_demand_kwh_a_3 = Number(heating_energy_demand_kwh_a)
cooling_energy_demand_kwh_a_3 = Number(cooling_energy_demand_kwh_a)
primary_energy_demand_kwh_a_2 = Number(primary_energy_demand_kwh_a)
primary_energy_demand_kwh_a_3 = Number(primary_energy_demand_kwh_a)
final_energy_demand_kwh_a_2 = Number(final_energy_demand_kwh_a)
final_energy_demand_kwh_a_3 = Number(final_energy_demand_kwh_a)
construction_gwp_kgco2e_2 = Number(construction_gwp_kgco2e)
construction_gwp_kgco2e_3 = Number(construction_gwp_kgco2e)
life_cycle_gwp_kgco2e_2 = Number(life_cycle_gwp_kgco2e)
life_cycle_gwp_kgco2e_3 = Number(life_cycle_gwp_kgco2e)
effective_floor_area_m² = Number(sumqal_2.num_2)
effective_floor_area_m²_2 = Number(sumqal_2.num_2)
effective_floor_area_m²_3 = Number(sumqal_2.num_2)
effective_floor_area_m²_4 = Number(sumqal_2.num_2)
effective_floor_area_m²_5 = Number(sumqal_2.num_2)
effective_floor_area_m²_6 = Number(sumqal_2.num_2)
effective_floor_area_m²_7 = Number(sumqal_2.num_2)
effective_floor_area_m²_8 = Number(sumqal_2.num_2)
effective_floor_area_m²_9 = Number(sumqal_2.num_2)
effective_floor_area_m²_10 = Number(sumqal_2.num_2)
construction_cost_2 = Number(addition_13)
life_cycle_income = Number(multiplication_18)
construction_cost_3 = Number(addition_13)
life_cycle_cost = Number(addition_14)
life_cycle_cost_2 = Number(addition_14)
life_cycle_cost_3 = Number(addition_14)
floor_area_m² = Number(sumqal.num_2)
users_person_2 = Number(users_person)
users_person_3 = Number(users_person)
users_person_4 = Number(users_person)
users_person_5 = Number(users_person)
users_person_6 = Number(users_person)
users_person_7 = Number(users_person)
users_person_8 = Number(users_person)
users_person_9 = Number(users_person)
users_person_10 = Number(users_person)
division = Division(A=effective_floor_area_m², B=floor_area_m²)
division_2 = Division(A=effective_floor_area_m²_5, B=users_person_5)
division_3 = Division(A=construction_cost_2, B=effective_floor_area_m²_2)
division_4 = Division(A=construction_cost_3, B=users_person_6)
division_5 = Division(A=life_cycle_cost_2, B=effective_floor_area_m²_3)
division_6 = Division(A=life_cycle_cost_3, B=users_person_7)
division_7 = Division(A=construction_gwp_kgco2e_2, B=effective_floor_area_m²_6)
division_8 = Division(A=construction_gwp_kgco2e_3, B=users_person_8)
division_9 = Division(A=life_cycle_gwp_kgco2e_2, B=effective_floor_area_m²_4)
division_10 = Division(A=life_cycle_gwp_kgco2e_3, B=users_person_9)
division_11 = Division(A=primary_energy_demand_kwh_a_2, B=effective_floor_area_m²_7)
division_12 = Division(A=primary_energy_demand_kwh_a_3, B=users_person_10)
division_13 = Division(A=final_energy_demand_kwh_a_2, B=effective_floor_area_m²_8)
division_14 = Division(A=final_energy_demand_kwh_a_3, B=users_person_2)
division_15 = Division(A=heating_energy_demand_kwh_a_2, B=effective_floor_area_m²_9)
division_16 = Division(A=heating_energy_demand_kwh_a_3, B=users_person_3)
division_17 = Division(A=cooling_energy_demand_kwh_a_2, B=effective_floor_area_m²_10)
division_18 = Division(A=cooling_energy_demand_kwh_a_3, B=users_person_4)
expression_3 = Expression(Start=construction_cost, End=life_cycle_income, Expression="((End-Start)/Start)*100")
area_comfort_m²_person = Number(division_2)
life_cycle_cost_4 = Number(life_cycle_cost)
specific_life_cycle_cost_m² = Number(division_5)
construction_global_warming_potential_pe = Number(division_8)  # "Construction Global Warming Potential per User [kgCO2e/Person]"
specific_life_cycle_global_warming_poten = Number(division_9)  # "Specific Life Cycle Global Warming Potential [kgCO2e/m²]"
life_cycle_global_warming_potential_per = Number(division_10)  # "Life Cycle Global Warming Potential per User [kgCO2e/Person]"
primary_energy_demand_kwh_a_4 = Number(primary_energy_demand_kwh_a)
primary_energy_demand_per_user_kwh_perso = Number(division_12)  # "Primary Energy Demand per User [kWh/Person a]"
final_energy_demand_kwh_a_4 = Number(final_energy_demand_kwh_a)
specific_final_energy_demand_kwh_m²a = Number(division_13)
ventilation_air_flow_volume_m³_s = Number(sumqal_15.num_2)
area_efficiency_eff_m²_m² = Number(division)
income_a_2 = Number(sumqal_7.num_2)
expenses_a_2 = Number(addition_12)
energy_expenses_a_2 = Number(addition_9)
effective_floor_area_m²_11 = Number(sumqal_2.num_2)
floor_area_m²_2 = Number(sumqal.num_2)
users_person_11 = Number(users_person)
construction_cost_4 = Number(addition_13)
specific_construction_cost_m² = Number(division_3)
construction_cost_per_user_person = Number(division_4)
life_cycle_cost_per_user_person = Number(division_6)
construction_global_warming_potential_kg = Number(construction_gwp_kgco2e)  # "Construction Global Warming Potential [kgCO2e]"
specific_construction_global_warming_pot = Number(division_7)  # "Specific Construction Global Warming Potential [kgCO2e/m²]"
life_cycle_global_warming_potential_kgco = Number(life_cycle_gwp_kgco2e)  # "Life Cycle Global Warming Potential [kgCO2e]"
specific_primary_energy_demand_kwh_m²a = Number(division_11)
final_energy_demand_per_user_kwh_person = Number(division_14)  # "Final Energy Demand per User [kWh/Person a]"
heating_load_kw = Number(sumqal_13.num_2)
heating_energy_demand_kwh_a_4 = Number(heating_energy_demand_kwh_a)
specific_heating_energy_demand_kwh_m²a = Number(division_15)
heating_energy_demand_per_user_kwh_perso = Number(division_16)  # "Heating Energy Demand per User [kWh/Person a]"
cooling_load_kw = Number(sumqal_14.num_2)
cooling_energy_demand_kwh_a_4 = Number(cooling_energy_demand_kwh_a)
specific_cooling_energy_demand_kwh_m²a = Number(division_17)
cooling_energy_demand_per_user_kwh_perso = Number(division_18)  # "Cooling Energy Demand per User [kWh/Person a]"
interest = Number(expression_3)
panel = Panel("""interest
area efficiency 
area comfort 
income
expenses 
energy expenses 
effective floor area 
floor area 
users 
construction cost 
specific construction cost 
construction cost per user 
life cycle cost 
specific life cycle cost 
life cycle cost per user 
construction global warming potential 
specific construction global warming potential 
construction global warming potential per user 
life cycle global warming potential 
specific life cycle global warming potential 
life cycle global warming potential per user 
primary energy demand 
specific primary energy demand 
primary energy demand per user 
final energy demand 
specific final energy demand 
final energy demand per user 
heating load 
heating energy demand 
specific heating energy demand 
heating energy demand per user 
cooling load 
cooling energy demand 
specific cooling energy demand 
cooling energy demand per user 
ventilation air flow volume  """)
merge = Merge(
    Data1=interest,
    Data2=area_efficiency_eff_m²_m²,
    Data3=area_comfort_m²_person,
    Data4=income_a_2,
    Data5=expenses_a_2,
    Data6=energy_expenses_a_2,
    Data7=effective_floor_area_m²_11,
    Data8=floor_area_m²_2,
    Data9=users_person_11,
    Data10=construction_cost_4,
    Data11=specific_construction_cost_m²,
    Data12=construction_cost_per_user_person,
    Data13=life_cycle_cost_4,
    Data14=specific_life_cycle_cost_m²,
    Data15=life_cycle_cost_per_user_person,
    Data16=construction_global_warming_potential_kg,
    Data17=specific_construction_global_warming_pot,
    Data18=construction_global_warming_potential_pe,
    Data19=life_cycle_global_warming_potential_kgco,
    Data20=specific_life_cycle_global_warming_poten,
    Data21=life_cycle_global_warming_potential_per,
    Data22=primary_energy_demand_kwh_a_4,
    Data23=specific_primary_energy_demand_kwh_m²a,
    Data24=primary_energy_demand_per_user_kwh_perso,
    Data25=final_energy_demand_kwh_a_4,
    Data26=specific_final_energy_demand_kwh_m²a,
    Data27=final_energy_demand_per_user_kwh_person,
    Data28=heating_load_kw,
    Data29=heating_energy_demand_kwh_a_4,
    Data30=specific_heating_energy_demand_kwh_m²a,
    Data31=heating_energy_demand_per_user_kwh_perso,
    Data32=cooling_load_kw,
    Data33=cooling_energy_demand_kwh_a_4,
    Data34=specific_cooling_energy_demand_kwh_m²a,
    Data35=cooling_energy_demand_per_user_kwh_perso,
    Data36=ventilation_air_flow_volume_m³_s)
dsn = ModelDesign(Design=dn_2)  # -> Design, Valid, Name, Description, Icon, Image, Variant, View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
panel_2 = Panel(merge)
trim = TrimTree(Tree=dsn.Qualities, Depth=1)
panel_3 = Panel("""%
eff. m²/m²
m²/Person
€/a
€/a
€/a
m²
m²
Person
€
€/m²
€/Person
€
€/m²
€/Person
kgCO2e
kgCO2e/m²
kgCO2e/Person
kgCO2e
kgCO2e/m²
kgCO2e/Person
kWh/a
kWh/m²a
kWh/Person a
kWh/a
kWh/m²a
kWh/Person a
kW
kWh/a
kWh/m²a
kWh/Person a
kW
kWh/a
kWh/m²a
kWh/Person a
m³/s""")
qal = ModelQuality(Name=panel, Value=merge, Unit=panel_3)  # -> Quality, Valid, Name, Value, Unit, Definition
merge_2 = Merge(Data1=trim, Data2=qal.Quality)
dsn_2 = ModelDesign(Design=dsn.Design, Qualities=merge_2)  # -> Design, Valid, Name, Description, Icon, Image, Variant, View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
dn_3 = ClusterOutput(dsn_2.Design)
interest_2 = ClusterOutput(interest)
area_efficiency_eff_m²_m²_2 = ClusterOutput(area_efficiency_eff_m²_m²)
area_comfort_m²_person_2 = ClusterOutput(area_comfort_m²_person)
income_a_3 = ClusterOutput(income_a_2)
expenses_a_3 = ClusterOutput(expenses_a_2)
energy_expenses_a_3 = ClusterOutput(energy_expenses_a_2)
effective_floor_area_m²_12 = ClusterOutput(effective_floor_area_m²_11)
floor_area_m²_3 = ClusterOutput(floor_area_m²_2)
users_person_12 = ClusterOutput(users_person_11)
construction_cost_5 = ClusterOutput(construction_cost_4)
specific_construction_cost_m²_2 = ClusterOutput(specific_construction_cost_m²)
construction_cost_per_user_person_2 = ClusterOutput(construction_cost_per_user_person)
life_cycle_cost_5 = ClusterOutput(life_cycle_cost_4)
specific_life_cycle_cost_m²_2 = ClusterOutput(specific_life_cycle_cost_m²)
life_cycle_cost_per_user_person_2 = ClusterOutput(life_cycle_cost_per_user_person)
construction_global_warming_potential_kg_2 = ClusterOutput(construction_global_warming_potential_kg)  # "Construction Global Warming Potential [kgCO2e]"
specific_construction_global_warming_pot_2 = ClusterOutput(specific_construction_global_warming_pot)  # "Specific Construction Global Warming Potential [kgCO2e/m²]"
construction_global_warming_potential_pe_2 = ClusterOutput(construction_global_warming_potential_pe)  # "Construction Global Warming Potential per User [kgCO2e/Person]"
life_cycle_global_warming_potential_kgco_2 = ClusterOutput(life_cycle_global_warming_potential_kgco)  # "Life Cycle Global Warming Potential [kgCO2e]"
specific_life_cycle_global_warming_poten_2 = ClusterOutput(specific_life_cycle_global_warming_poten)  # "Specific Life Cycle Global Warming Potential [kgCO2e/m²]"
life_cycle_global_warming_potential_per_2 = ClusterOutput(life_cycle_global_warming_potential_per)  # "Life Cycle Global Warming Potential per User [kgCO2e/Person]"
primary_energy_demand_kwh_a_5 = ClusterOutput(primary_energy_demand_kwh_a_4)
specific_primary_energy_demand_kwh_m²a_2 = ClusterOutput(specific_primary_energy_demand_kwh_m²a)
primary_energy_demand_per_user_kwh_perso_2 = ClusterOutput(primary_energy_demand_per_user_kwh_perso)  # "Primary Energy Demand per User [kWh/Person a]"
final_energy_demand_kwh_a_5 = ClusterOutput(final_energy_demand_kwh_a_4)
specific_final_energy_demand_kwh_m²a_2 = ClusterOutput(specific_final_energy_demand_kwh_m²a)
final_energy_demand_per_user_kwh_person_2 = ClusterOutput(final_energy_demand_per_user_kwh_person)  # "Final Energy Demand per User [kWh/Person a]"
heating_load_kw_2 = ClusterOutput(heating_load_kw)
heating_energy_demand_kwh_a_5 = ClusterOutput(heating_energy_demand_kwh_a_4)
specific_heating_energy_demand_kwh_m²a_2 = ClusterOutput(specific_heating_energy_demand_kwh_m²a)
heating_energy_demand_per_user_kwh_perso_2 = ClusterOutput(heating_energy_demand_per_user_kwh_perso)  # "Heating Energy Demand per User [kWh/Person a]"
cooling_load_kw_2 = ClusterOutput(cooling_load_kw)
cooling_energy_demand_kwh_a_5 = ClusterOutput(cooling_energy_demand_kwh_a_4)
specific_cooling_energy_demand_kwh_m²a_2 = ClusterOutput(specific_cooling_energy_demand_kwh_m²a)
cooling_energy_demand_per_user_kwh_perso_2 = ClusterOutput(cooling_energy_demand_per_user_kwh_perso)  # "Cooling Energy Demand per User [kWh/Person a]"
ventilation_air_flow_volume_m³_s_2 = ClusterOutput(ventilation_air_flow_volume_m³_s)

# ==== cluster ShowDesign: Show a design by flattening it and selecting representations based on mime and tags. Select exactly one representation based on mime and tags. The tag matching is based on the highest Jaccard index (|∩|/|∪|). If the mime type is not given or does not exist, then all representations are used to search for closest match. If index is equally high the first representation is picked.
dn = ClusterInput()
ty = ClusterInput()
O = ClusterInput()
mm = ClusterInput()
tags = ClusterInput()
ty_2 = Type(ty)
dn_2 = Design(dn)
O_2 = Data(O)
mm_2 = Mime(mm)
tags_2 = Tags(tags)
fltdsn = FlattenDesign(Design=dn_2, Type=ty_2)
dsn = ModelDesign(Design=fltdsn)  # -> Design, Valid, Name, Description, Icon, Image, Variant, View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
typ = ModelType(Type=ty_2)  # -> Type, Valid, Name, Description, Icon, Image, Variant, Unit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
trim = TrimTree(Tree=dsn.Pieces, Depth=1)
rep = ModelRepresentation(Representation=typ.Representations)  # -> Representation, Valid, Url, Description, Mime, Tags, Qualities
pce = ModelPiece(Piece=trim)  # -> Piece, Valid, Id, Description, TypeName, TypeVariant, Plane, Center, Qualities
tstat = TreeStatistics(Tree=typ.Representations)  # -> Paths, Length, Count
tstat_2 = TreeStatistics(Tree=graft(rep.Url))  # -> Paths, Length, Count
expression = Expression(x=graft(pce.TypeVariant), y=typ.Variant, Expression="x=y")
expression_2 = Expression(x=graft(pce.TypeName), y=typ.Name, Expression="x=y")
trim_2 = TrimTree(Tree=rep.Url, Depth=1)
and = GateAnd(A=expression_2, B=expression)
cull = CullPattern(List=ty_2, CullPattern=and)
lng = ListLength(List=ty_2)
series = Series(Start=0, Step=1, Count=lng)
txt = Text(cull)
txt_2 = Text(ty_2)
expression_3 = Expression(x=txt, y=txt_2, Expression="x=y")
trim_3 = TrimTree(Tree=series, Depth=1)
cull_2 = CullPattern(List=trim_3, CullPattern=expression_3)
trim_4 = TrimTree(Tree=cull_2, Depth=1)
item = ListItem(List=tstat.Paths, Index=trim_4, Wrap=True)
branch = TreeBranch(Tree=typ.Representations, Path=item, MaintainPaths=False)
lng_2 = ListLength(List=typ.Representations)
mrg_p = MergeSeperatlyPrepend(x=branch)  # -> Mrgd; inputs x: tree
# ---------- mrg_p: Python ----------
if ghenv.Component.RunCount<2:
    __author__ = "Ueli Saluz"
    __version__ = "2020.05.28"
    
    ghenv.Component.Name = "MergeSeperatly(Prepend)"
    ghenv.Component.NickName = "Mrg(P)"
    ghenv.Component.Description = "Merge inputs seperatly on a new path. Prepend index of input parameter for distincting."
    ghenv.Component.Message = "VER 1.0"

from System import Object
from Grasshopper import DataTree
from Grasshopper.Kernel import GH_ParamAccess as Access

if __name__ == "__main__":
    Mrgd = DataTree[Object]()
    access = Access()
    
    for input in ghenv.Component.Params.Input:  #set all Inputaccess to Tree Access
        input.Access = access.tree
    
    for i,input in enumerate(ghenv.Component.Params.Input):
        for j,source in enumerate(input.Sources):
            for path in source.VolatileData.Paths:
                Mrgd.AddRange(source.VolatileData[path],path.PrependElement(i))
# ---------- end mrg_p ----------
expression_4 = Expression(x=lng_2, Expression="x=0")
rep_2 = SelectRepresentation(rp=mrg_p, mm=mm_2, tags=tags_2)  # -> rp_5, i_2, ur_2, pa_ur_2
filter = StreamFilter(Gate=expression_4, Stream1=O_2)
trim_5 = TrimTree(Tree=rep_2.rp_5, Depth=1)
filter_2 = StreamFilter(Gate=expression_4, Stream0=trim_5)
trim_6 = TrimTree(Tree=rep_2.ur_2, Depth=1)
itemindex = ItemIndex(L=trim_2, I=trim_6)  # -> i; inputs L: list; same code as itemindex
item_2 = ListItem(List=tstat_2.Paths, Index=itemindex, Wrap=True)
branch_2 = TreeBranch(Tree=O_2, Path=item_2, MaintainPaths=False)
mrg_p_2 = MergeSeperatlyPrepend(x=branch_2)  # -> Mrgd; inputs x: tree; same code as mrg_p
trim_7 = TrimTree(Tree=rep_2.pa_ur_2, Depth=1)
id = Id(pce.Id)
pln = Plane(pce.Plane)
rp = Representation(filter_2)
orient = Orient(Geometry=mrg_p_2, Source=PlaneXY(0, 0, 0), Target=graft(pln))  # -> Geometry, Transform
O_3 = ModelObject(orient.Geometry)
rp_2 = ClusterOutput(rp)
pln_2 = ClusterOutput(pln)
id_2 = ClusterOutput(id)
O_4 = ClusterOutput(O_3)

# ==== cluster SelectPiece: Select a piece with the id.
pc = ClusterInput()
id = ClusterInput()
id_2 = Id(graft(id))
pc_2 = Piece(pc)
pce = ModelPiece(Piece=pc_2)  # -> Piece, Valid, Id, Description, TypeName, TypeVariant, Plane, Center, Qualities
lng = ListLength(List=pc_2)
series = Series(Start=0, Step=1, Count=lng)
expression = Expression(x=pce.Id, y=id_2, Expression="x=y")
trim = TrimTree(Tree=series, Depth=1)
cull = CullPattern(List=pce.Piece, CullPattern=expression)
cull_2 = CullPattern(List=trim, CullPattern=expression)
trim_2 = TrimTree(Tree=cull_2, Depth=1)
trim_3 = TrimTree(Tree=cull, Depth=1)
pc_3 = Piece(trim_3)
i = Integer(trim_2)
pc_4 = ClusterOutput(pc_3)
i_2 = ClusterOutput(i)

# ==== cluster SelectConnection: Select a connection with the connected id and the connecting id. The connections are symetric, so if the conected is the connecting and vice versa it will still selct them.
co = ClusterInput()
cdpc = ClusterInput()
cgpc = ClusterInput()
cdpc_2 = ConnectedPieceId(graft(cdpc))
cgpc_2 = ConnectingPieceId(graft(cgpc))
co_2 = Connection(co)
con = ModelConnection(Connection=co_2)  # -> Connection, Valid, ConnectedPieceId, ConnectedPieceTypePortId, ConnectingPieceId, ConnectingPieceTypePortId, Description, Gap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
expression = Expression(x=con.ConnectedPieceId, y=cdpc_2, Expression="x=y")
expression_2 = Expression(x=con.ConnectedPieceId, y=cgpc_2, Expression="x=y")
expression_3 = Expression(x=con.ConnectingPieceId, y=cgpc_2, Expression="x=y")
expression_4 = Expression(x=con.ConnectingPieceId, y=cdpc_2, Expression="x=y")
lng = ListLength(List=co_2)
series = Series(Start=0, Step=1, Count=lng)
and = GateAnd(A=expression, B=expression_3)
and_2 = GateAnd(A=expression_2, B=expression_4)
trim = TrimTree(Tree=series, Depth=1)
or = GateOr(A=and, B=and_2)
not = GateNot(A=and)
cull = CullPattern(List=con.Connection, CullPattern=or)
and_3 = GateAnd(A=not, B=and_2)
cull_2 = CullPattern(List=trim, CullPattern=or)
nulltobranch = AddNullToEmptyBranch(D=cull)  # -> R; inputs D: tree
# ---------- nulltobranch: C# ----------
#region Usings
using System;
using System.Linq;
using System.Collections;
using System.Collections.Generic;
using System.Drawing;

using Rhino;
using Rhino.Geometry;

using Grasshopper;
using Grasshopper.Kernel;
using Grasshopper.Kernel.Data;
using Grasshopper.Kernel.Types;
#endregion

public class Script_Instance : GH_ScriptInstance
{

    private void RunScript(DataTree<object> D, ref object R)
    {
        foreach (GH_Path path in D.Paths)
            if (D.Branch(path).Count == 0)
                D.Add(null, path);

        R = D;
    }
}
# ---------- end nulltobranch ----------
nulltobranch_2 = AddNullToEmptyBranch(D=cull_2)  # -> R; inputs D: tree; same code as nulltobranch
ma = MassAddition(Input=and_3)  # -> Result, PartialResults
trim_2 = TrimTree(Tree=nulltobranch, Depth=1)
trim_3 = TrimTree(Tree=nulltobranch_2, Depth=1)
trim_4 = TrimTree(Tree=ma.Result, Depth=1)
co_3 = Connection(trim_2)
fl = Boolean(trim_4)
i = Integer(trim_3)
co_4 = ClusterOutput(co_3)
fl_2 = ClusterOutput(fl)
i_2 = ClusterOutput(i)

# ==== cluster NormalizeDesign: Normalize a design for this document. This includes changing the unit to the document unit and rescaling the affected values. Further it reoders pieces, connections and qualities. Connections might be swapped, so that the connected piece id is lexically first. The order of authors is not changed.
dn = ClusterInput()
dn_2 = Design(graft(dn))
dsn = ModelDesign(Design=dn_2)  # -> Design, Valid, Name, Description, Icon, Image, Variant, View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
dsn_2 = ModelDesign()  # -> Design, Valid, Name, Description, Icon, Image, Variant, View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
cnvunt = ConvertUnit(Value=1, FromUnit=dsn.Unit, ToUnit=dsn_2.Unit)
trim = TrimTree(Tree=dsn.Pieces, Depth=1)
trim_2 = TrimTree(Tree=dsn.Connections, Depth=1)
trim_3 = TrimTree(Tree=dsn.Qualities, Depth=1)
con = ModelConnection(Connection=trim_2)  # -> Connection, Valid, ConnectedPieceId, ConnectedPieceTypePortId, ConnectingPieceId, ConnectingPieceTypePortId, Description, Gap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
multiplication = Multiplication(A=con.Gap, B=cnvunt)
multiplication_2 = Multiplication(A=con.Shift, B=cnvunt)
multiplication_3 = Multiplication(A=con.Raise, B=cnvunt)
con_2 = ModelConnection(Connection=con.Connection, Gap=multiplication, Shift=multiplication_2, Raise=multiplication_3)  # -> Connection, Valid, ConnectedPieceId, ConnectedPieceTypePortId, ConnectingPieceId, ConnectingPieceTypePortId, Description, Gap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
merge = Merge(Data1=graft(con_2.ConnectedPieceId), Data2=graft(con_2.ConnectingPieceId))
tsort = SortText(Keys=merge, Culture=127)  # -> Keys, Values
trim_4 = TrimTree(Tree=tsort.Keys, Depth=1)
expression = Expression(x=merge, y=trim_4, Expression="x=y")
item = ListItem(List=expression, Index=0, Wrap=True)
trim_5 = TrimTree(Tree=item, Depth=1)
dispatch = Dispatch(List=con_2.Connection, DispatchPattern=trim_5)  # -> ListA, ListB
con_3 = ModelConnection(Connection=dispatch.ListB)  # -> Connection, Valid, ConnectedPieceId, ConnectedPieceTypePortId, ConnectingPieceId, ConnectingPieceTypePortId, Description, Gap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
txt = Text(dispatch.ListB)
clean = CleanTree(RemoveNulls=True, RemoveInvalid=True, RemoveEmpty=invert(False), Tree=txt)
con_4 = ModelConnection(
    Connection=dispatch.ListB,
    ConnectedPieceId=con_3.ConnectingPieceId,
    ConnectedPieceTypePortId=con_3.ConnectingPieceTypePortId,
    ConnectingPieceId=con_3.ConnectedPieceId,
    ConnectingPieceTypePortId=con_3.ConnectedPieceTypePortId)  # -> Connection, Valid, ConnectedPieceId, ConnectedPieceTypePortId, ConnectingPieceId, ConnectingPieceTypePortId, Description, Gap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
tstat = TreeStatistics(Tree=clean)  # -> Paths, Length, Count
branch = TreeBranch(Tree=con_4.Connection, Path=tstat.Paths, MaintainPaths=True)
merge_2 = Merge(Data1=dispatch.ListA, Data2=branch)
con_5 = ModelConnection(Connection=merge_2)  # -> Connection, Valid, ConnectedPieceId, ConnectedPieceTypePortId, ConnectingPieceId, ConnectingPieceTypePortId, Description, Gap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
qal = ModelQuality(Quality=trim_3)  # -> Quality, Valid, Name, Value, Unit, Definition
pce = ModelPiece(Piece=trim)  # -> Piece, Valid, Id, Description, TypeName, TypeVariant, Plane, Center, Qualities
concat = Concatenate(FragmentA=con_5.ConnectedPieceId, FragmentC="##", FragmentB=con_5.ConnectingPieceId)
tsort_2 = SortText(Keys=pce.Id, Values=pce.Piece, Culture=127)  # -> Keys, Values
tsort_3 = SortText(Keys=qal.Name, Values=qal.Quality, Culture=127)  # -> Keys, Values
tsort_4 = SortText(Keys=concat, Values=con_5.Connection, Culture=127)  # -> Keys, Values
trim_6 = TrimTree(Tree=tsort_2.Values, Depth=1)
trim_7 = TrimTree(Tree=tsort_4.Values, Depth=1)
trim_8 = TrimTree(Tree=tsort_3.Values, Depth=1)
dsn_3 = ModelDesign(Design=dsn.Design, Unit=dsn_2.Unit, Pieces=trim_6, Connections=trim_7, Qualities=trim_8)  # -> Design, Valid, Name, Description, Icon, Image, Variant, View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
trim_9 = TrimTree(Tree=dsn_3.Design, Depth=1)
dn_3 = Design(trim_9)
dn_4 = ClusterOutput(dn_3)

# ==== cluster SumQualities: Sum up the qualities of a type for each piece with this type in a design.
dn = ClusterInput()
ty = ClusterInput()
na = ClusterInput()
dn_2 = Design(dn)
ty_2 = Type(ty)
na_2 = Name(na)
dsn = ModelDesign(Design=dn_2)  # -> Design, Valid, Name, Description, Icon, Image, Variant, View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
typ = ModelType(Type=ty_2)  # -> Type, Valid, Name, Description, Icon, Image, Variant, Unit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
qal = ModelQuality(Quality=typ.Qualities)  # -> Quality, Valid, Name, Value, Unit, Definition
trim = TrimTree(Tree=dsn.Pieces, Depth=1)
pce = ModelPiece(Piece=trim)  # -> Piece, Valid, Id, Description, TypeName, TypeVariant, Plane, Center, Qualities
expression = Expression(x=graft(pce.TypeName), y=typ.Name, Expression="x=y")
expression_2 = Expression(x=graft(pce.TypeVariant), y=typ.Variant, Expression="x=y")
expression_3 = Expression(x=na_2, y=qal.Name, Expression="x=y")
and = GateAnd(A=expression, B=expression_2)
cull = CullPattern(List=typ.Qualities, CullPattern=expression_3)
cull_2 = CullPattern(List=ty_2, CullPattern=and)
qal_2 = ModelQuality(Quality=cull)  # -> Quality, Valid, Name, flatten(Value), Unit, Definition
lng = ListLength(List=ty_2)
txt = Text(cull_2)
txt_2 = Text(ty_2)
series = Series(Start=0, Step=1, Count=lng)
expression_4 = Expression(x=txt, y=txt_2, Expression="x=y")
trim_2 = TrimTree(Tree=series, Depth=1)
cull_3 = CullPattern(List=trim_2, CullPattern=expression_4)
trim_3 = TrimTree(Tree=cull_3, Depth=1)
item = ListItem(List=qal_2.Value, Index=trim_3, Wrap=True)
clean = CleanTree(RemoveNulls=True, RemoveInvalid=True, RemoveEmpty=False, Tree=item)
ma = MassAddition(Input=clean)  # -> Result, PartialResults
num = Number(ma.Result)
ql = Quality(qal_2.Quality)
num_2 = ClusterOutput(num)
ql_2 = ClusterOutput(ql)

# ==== cluster SelectRepresentation: Select exactly one representation based on mime and tags. The tag matching is based on the highest Jaccard index (|∩|/|∪|). If the mime type is not given or does not exist, then all representations are used to search for closest match. If index is equally high the first representation is picked.
mm = ClusterInput()
tags = ClusterInput()
rp = ClusterInput()
rp_2 = Representation(rp)
mm_2 = Mime(mm)
tags_2 = Tags(tags)
l2o = List2Object(L=rp_2)  # -> O; inputs L: tree
# ---------- l2o: Python ----------
#Component Information
#--------------------------------------------------------------------------------------------
if ghenv.Component.RunCount<2:
    #General
    #--------------------------------------------------------------------------------------------
    __author__ = "Ueli Saluz"
    __version__ = "2022.04.24"
    
    ghenv.Component.Name = "List2Object"
    ghenv.Component.NickName = "L2O"
    ghenv.Component.Description = "Wraps a list of objects into a list object."
    ghenv.Component.Message = "VER 1.0"
    ghenv.Component.Category = "Sets"
    ghenv.Component.SubCategory = "Tree"
    
     #Inputs
    #--------------------------------------------------------------------------------------------
    inputIndex=0
    
    ghenv.Component.Params.Input[inputIndex].Name = "List"
    ghenv.Component.Params.Input[inputIndex].NickName = "L"
    ghenv.Component.Params.Input[inputIndex].Description = "Tree with lists to wrap."
    ghenv.Component.Params.Input[inputIndex].Optional = False
    inputIndex+=1
    

    #Outputs
    #--------------------------------------------------------------------------------------------
    outputIndex=0
    
    ghenv.Component.Params.Output[outputIndex].Name =  "ListObject" 
    ghenv.Component.Params.Output[outputIndex].NickName = "O"
    ghenv.Component.Params.Output[outputIndex].Description = "Python list object as single item."
    outputIndex+=1


#Imports
#--------------------------------------------------------------------------------------------
from System import Object
from Grasshopper import DataTree

#Solver - Run with trees to enhance performance drastically
#--------------------------------------------------------------------------------------------
if __name__ == "__main__":
    
    #Initialize trees
    #--------------------------------------------------------------------------------------------
    TreeToWrap = DataTree[Object]()
    
    #Data matching
    #--------------------------------------------------------------------------------------------
    for path in L.Paths:
        listBranch = L.Branch(path)
        TreeToWrap.Add(listBranch,path)
    
     #Assign trees to output
    #--------------------------------------------------------------------------------------------
    O = TreeToWrap
# ---------- end l2o ----------

rep = ModelRepresentation(Representation=graft(rp_2))  # -> Representation, Valid, Url, Description, Mime, Tags, Qualities
lng = ListLength(List=mm_2)
expression = Expression(x=rep.Mime, y=mm_2, Expression="x=y")
null = NullItem(Item=lng)  # -> NullFlags, InvalidFlags, Description
expression_2 = Expression(x=lng, Expression="x=0")
ma = MassAddition(Input=expression)  # -> Result, PartialResults
or = GateOr(A=expression_2, B=null.NullFlags)
cull = CullPattern(List=rep.Representation, CullPattern=ma.Result)
trim = TrimTree(Tree=cull, Depth=1)
mime_match = Representation(trim)
nulltobranch = CSharpScript(D=mime_match)  # -> R; inputs D: tree; same code as nulltobranch
nullrep = ReplaceNulls(Items=nulltobranch, Replacements=l2o)  # -> graft(Items), Count

o2l = Object2List(O=nullrep.Items)  # -> L; inputs O: tree
# ---------- o2l: Python ----------
# Component Information
# --------------------------------------------------------------------------------------------
if ghenv.Component.RunCount < 2:
    # General
    # --------------------------------------------------------------------------------------------
    __author__ = "Ueli Saluz"
    __version__ = "2025.02.19"

    ghenv.Component.Name = "Object2List"
    ghenv.Component.NickName = "O2L"
    ghenv.Component.Description = "Unwraps a list of objects into a list object and returns the object if it is not iterable."
    ghenv.Component.Message = "VER 1.1"
    ghenv.Component.Category = "Sets"
    ghenv.Component.SubCategory = "Tree"

    # Inputs
    # --------------------------------------------------------------------------------------------
    inputIndex = 0

    ghenv.Component.Params.Input[inputIndex].Name = "ListObject"
    ghenv.Component.Params.Input[inputIndex].NickName = "O"
    ghenv.Component.Params.Input[inputIndex].Description = "A python list object that will be unwrapped into a Grasshopper list or returned as is if not iterable."
    ghenv.Component.Params.Input[inputIndex].Optional = False
    inputIndex += 1

    # Outputs
    # --------------------------------------------------------------------------------------------
    outputIndex = 0

    ghenv.Component.Params.Output[outputIndex].Name = "List"
    ghenv.Component.Params.Output[outputIndex].NickName = "L"
    ghenv.Component.Params.Output[outputIndex].Description = "The unwrapped list."
    outputIndex += 1

# Imports
# --------------------------------------------------------------------------------------------
from System import Object
from Grasshopper import DataTree
from collections import Iterable

# Solver - Run with trees to enhance performance drastically
# --------------------------------------------------------------------------------------------
if __name__ == "__main__":

    # Initialize trees
    # --------------------------------------------------------------------------------------------
    OriginalTree = DataTree[Object]()

    # Data matching
    # --------------------------------------------------------------------------------------------
    for path in O.Paths:
        listBranch = O.Branch(path)
        for i, listItem in enumerate(listBranch):
            if isinstance(listItem, Iterable) and not isinstance(listItem, str):
                OriginalTree.AddRange(list(listItem), path.AppendElement(i))
            else:
                OriginalTree.Add(listItem, path.AppendElement(i))

    # Assign trees to output
    # --------------------------------------------------------------------------------------------
    L = OriginalTree
# ---------- end o2l ----------
trim_2 = TrimTree(Tree=o2l, Depth=1)
trim_3 = TrimTree(Tree=trim_2, Depth=1)

filter = StreamFilter(Gate=or, Stream0=trim_3, Stream1=rp_2)
rp_3 = Representation(filter)

rep_2 = ModelRepresentation(Representation=rp_3)  # -> Representation, Valid, Url, Description, Mime, Tags, Qualities
jac = JaccardIndex(set1=tags_2, set2=rep_2.Tags)
trim_4 = TrimTree(Tree=jac, Depth=1)
minmax = MinimumMaximum(L=trim_4)  # -> Max, MaxI, Min, MinI; inputs L: list
# ---------- minmax: Python ----------
#Component Information
#--------------------------------------------------------------------------------------------
if ghenv.Component.RunCount<2:
    #General
    #--------------------------------------------------------------------------------------------
    __author__ = "Ueli Saluz"
    __version__ = "2022.04.22"
    
    ghenv.Component.Name = "MinimumMaximum"
    ghenv.Component.NickName = "MinMax"
    ghenv.Component.Description = "Returns the maximum and mininum of a list and their corresponding index."
    ghenv.Component.Message = "VER 1.0"
    ghenv.Component.Category = "Maths"
    ghenv.Component.SubCategory = "Util"
    
     #Inputs
    #--------------------------------------------------------------------------------------------
    inputIndex=0
    
    ghenv.Component.Params.Input[inputIndex].Name = "L"
    ghenv.Component.Params.Input[inputIndex].NickName = "L"
    ghenv.Component.Params.Input[inputIndex].Description = "A list of numbers."
    ghenv.Component.Params.Input[inputIndex].Optional = False
    inputIndex+=1
    
    
    #Outputs
    #--------------------------------------------------------------------------------------------
    outputIndex=0
    
    ghenv.Component.Params.Output[outputIndex].Name = "Max"
    ghenv.Component.Params.Output[outputIndex].NickName = "Max"
    ghenv.Component.Params.Output[outputIndex].Description = "Maximum of the list"
    outputIndex+=1
    
    ghenv.Component.Params.Output[outputIndex].Name = "MaxI"
    ghenv.Component.Params.Output[outputIndex].NickName = "MaxI"
    ghenv.Component.Params.Output[outputIndex].Description = "Index of the maximum of the list"
    outputIndex+=1
    
    ghenv.Component.Params.Output[outputIndex].Name = "Min"
    ghenv.Component.Params.Output[outputIndex].NickName = "Min"
    ghenv.Component.Params.Output[outputIndex].Description = "Minimum of the list"
    outputIndex+=1
    
    ghenv.Component.Params.Output[outputIndex].Name = "MinI"
    ghenv.Component.Params.Output[outputIndex].NickName = "MinI"
    ghenv.Component.Params.Output[outputIndex].Description = "Index of the minimum of the list"
    outputIndex+=1


#Solver - Run with trees to enhance performance drastically
#--------------------------------------------------------------------------------------------
if __name__ == "__main__":
    
    maximum = max(L)
    MaxI = L.index(maximum)
    Max = maximum
    
    minimum = min(L)
    MinI = L.index(minimum)
    Min = minimum
# ---------- end minmax ----------
item = ListItem(List=rep_2.Representation, Index=minmax.MaxI, Wrap=True)
rep_3 = ModelRepresentation(Representation=item)  # -> Representation, Valid, Url, Description, Mime, Tags, Qualities
sep = Separator()  # -> S; same code as sep
txt = Text(rp_2)
txt_2 = Text(item)
rep_4 = ReplaceText(Text=rep_3.Url, Find="/", Replace=sep, RecursiveReplace=False)
itemindex = ItemIndex(L=txt, I=txt_2)  # -> i; inputs L: list
# ---------- itemindex: Python ----------
#Component Information
#--------------------------------------------------------------------------------------------
if ghenv.Component.RunCount<2:
    #General
    #--------------------------------------------------------------------------------------------
    __author__ = "Ueli Saluz"
    __version__ = "2022.11.18"
    
    ghenv.Component.Name = "ItemIndex"
    ghenv.Component.NickName = "ItemIndex"
    ghenv.Component.Description = "A better IdemIndex"
    ghenv.Component.Message = "VER 1.0"
    ghenv.Component.Category = "Set"
    ghenv.Component.SubCategory = "List"
    
     #Inputs
    #--------------------------------------------------------------------------------------------
    inputIndex=0
    
    ghenv.Component.Params.Input[inputIndex].Name = "List"
    ghenv.Component.Params.Input[inputIndex].NickName = "L"
    ghenv.Component.Params.Input[inputIndex].Description = "Input1 is..."
    ghenv.Component.Params.Input[inputIndex].Optional = False
    inputIndex+=1
    
    ghenv.Component.Params.Input[inputIndex].Name = "Item"
    ghenv.Component.Params.Input[inputIndex].NickName = "I"
    ghenv.Component.Params.Input[inputIndex].Description = "Input2 is..."
    ghenv.Component.Params.Input[inputIndex].Optional = False
    inputIndex+=1
    
    #Outputs
    #--------------------------------------------------------------------------------------------
    outputIndex=0
    
    ghenv.Component.Params.Output[outputIndex].Name = "Index"
    ghenv.Component.Params.Output[outputIndex].NickName = "i"
    ghenv.Component.Params.Output[outputIndex].Description = "Output1 is..."
    outputIndex+=1

i = L.index(I)
# ---------- end itemindex ----------
rp_4 = Representation(item)
ur = Url(rep_3.Url)
pa_ur = Text(rep_4)

i = Integer(itemindex)
i_2 = ClusterOutput(i)
ur_2 = ClusterOutput(ur)
pa_ur_2 = ClusterOutput(pa_ur)
rp_5 = ClusterOutput(rp_4)

# ==== cluster JaccardIndex: Compute the Jaccard Index of two sets.
set1 = ClusterInput()
set2 = ClusterInput()
set1_2 = Data(set1)
set2_2 = Data(set2)
cset = CreateSet(List=set2_2)  # -> Set, Map
cset_2 = CreateSet(List=set1_2)  # -> Set, Map
lng = ListLength(List=set1_2)
lng_2 = ListLength(List=set2_2)
intersection = SetIntersection(SetA=cset_2.Set, SetB=cset.Set)
expression = Expression(x=lng, Expression="x=0")
expression_2 = Expression(x=lng_2, Expression="x=0")
sunion = SetUnion(SetA=cset_2.Set, SetB=cset.Set)
null = NullItem(Item=lng)  # -> NullFlags, InvalidFlags, Description
null_2 = NullItem(Item=lng_2)  # -> NullFlags, InvalidFlags, Description
lng_3 = ListLength(List=sunion)
lng_4 = ListLength(List=intersection)
or = GateOr(A=null.NullFlags, B=expression)
or_2 = GateOr(A=null_2.NullFlags, B=expression_2)
division = Division(A=lng_4, B=lng_3)
int = Integer(or)
int_2 = Integer(or_2)
concat = Concatenate(FragmentA=int, FragmentB=int_2)
b2d = BinaryToDecimal(Binary=concat)  # -> Decimal
# ---------- b2d: Python ----------
if ghenv.Component.RunCount<2:
    __author__ = "Ueli Saluz"
    __version__ = "2021.11.14"
    
    ghenv.Component.Name = "BinaryToDecimal"
    ghenv.Component.NickName = "B2D"
    ghenv.Component.Description = "Converts a number in binary representation to a number in decimal representation."
    ghenv.Component.Message = "VER 1.0"
    
    ghenv.Component.Params.Input[0].NickName = "Binary"
    
    ghenv.Component.Params.Input[0].Description = "Binary representation of a number."
    
    ghenv.Component.Params.Output[0].NickName = "Decimal"
    
    ghenv.Component.Params.Output[0].Description = "Converted decimal representation of the same number."

if __name__ == "__main__":
    Decimal = int(Binary,2)
# ---------- end b2d ----------
expression_3 = Expression(c=b2d, x=division, Expression="If(c=0,x,If(c=3,1,0))")
N = Number(expression_3)
N_2 = ClusterOutput(N)
