# Grasshopper definition capsule.gh (Grasshopper 1.0.8)
# Copyright: GNU Lesser General Public License Version 3
# Copyright: GNU Lesser General Public License v3.0 or later
# plug-ins: RhinoCodePluginGH, semio

save_representation = BooleanToggle(False)
variant = Slider(0, range=0..7)
icon_export = BooleanToggle(False)
validate = BooleanToggle(False)
save = BooleanToggle(False)
panel = Panel("""\
/
q
p
J
L
s
z""")
sep = Separator()  # -> S; same code as sep
dir = Directory()  # -> D
# ---------- dir: C# ----------
#region Usings
using System;
using System.Linq;
using System.Collections;
using System.Collections.Generic;
using System.Drawing;
using System.IO;

using Rhino;
using Rhino.Geometry;

using Grasshopper;
using Grasshopper.Kernel;
using Grasshopper.Kernel.Data;
using Grasshopper.Kernel.Types;
#endregion

public class Script_Instance : GH_ScriptInstance
{
    private void RunScript(ref object D)
    {
        D = Path.GetDirectoryName(this.GrasshopperDocument.FilePath);
    }
}
# ---------- end dir ----------
and = GateAnd(A=save, B=save_representation)
and_2 = GateAnd(A=save, B=icon_export)
loop_slider = PythonScript(SliderToModify=variant, Min="0", Max="7", stepSize="1", Delay=Slider(0, range=0..1), Run=Toggle(False), Reset=Button())  # inputs Run: Boolean, Reset: Boolean
# ---------- loop_slider: Python ----------
import time

def updateSliderInput(inputName,min,max,value,decimalPlace=2):
    for input in ghenv.Component.Params.Input:
        for source in input.Sources:
            if input.Name == str(inputName):
                source.Slider.DecimalPlaces = decimalPlace
                source.Slider.Minimum = min
                source.Slider.Maximum = max
                source.Slider.Value = value
                source.ExpireSolution(True)

def countDecimal(number):
    string= str(number)
    return string[::-1].find('.')

if Run == True:
    if SliderToModify < Max:
        time.sleep(Delay)
        updateSliderInput("SliderToModify",Min,Max,SliderToModify+stepSize,countDecimal(stepSize))
if Reset == True:
    updateSliderInput("SliderToModify",Min,Max,Min)
# ---------- end loop_slider ----------
# ^                                    ^
#    |                                     |
# <-- Constants    Preview -->
# Parameters    External    Local -->
# <-- Meta               |
#      |                       v
#      v
par = ParentDirectory(D=dir)  # -> P; inputs D: String
# ---------- par: C# ----------
#region Usings
using System;
using System.Linq;
using System.Collections;
using System.Collections.Generic;
using System.Drawing;
using System.IO;

using Rhino;
using Rhino.Geometry;

using Grasshopper;
using Grasshopper.Kernel;
using Grasshopper.Kernel.Data;
using Grasshopper.Kernel.Types;
#endregion

public class Script_Instance : GH_ScriptInstance
{
    private void RunScript(string D, ref object P)
    {
        P = new DirectoryInfo(D).Parent;
    }
}
# ---------- end par ----------
item = ListItem(List=panel, Index=variant, Wrap=True)
panel_2 = Panel(item)
variant_2 = GetString(item, AtLeast=0, AtMost=1, TreeAccess=False)
itemindex = ItemIndex(L=panel, I=variant_2)  # -> i; inputs L: list
# ---------- itemindex: Python ----------
#Component Information
#--------------------------------------------------------------------------------------------
if ghenv.Component.RunCount<2:
    #General
    #--------------------------------------------------------------------------------------------
    __author__ = "Ueli Saluz"
    __version__ = "2022.11.18"
    
    ghenv.Component.Name = "ItemIndex"
    ghenv.Component.NickName = "ItemIndex"
    ghenv.Component.Description = "A better IdemIndex"
    ghenv.Component.Message = "VER 1.0"
    ghenv.Component.Category = "Set"
    ghenv.Component.SubCategory = "List"
    
     #Inputs
    #--------------------------------------------------------------------------------------------
    inputIndex=0
    
    ghenv.Component.Params.Input[inputIndex].Name = "List"
    ghenv.Component.Params.Input[inputIndex].NickName = "L"
    ghenv.Component.Params.Input[inputIndex].Description = "Input1 is..."
    ghenv.Component.Params.Input[inputIndex].Optional = False
    inputIndex+=1
    
    ghenv.Component.Params.Input[inputIndex].Name = "Item"
    ghenv.Component.Params.Input[inputIndex].NickName = "I"
    ghenv.Component.Params.Input[inputIndex].Description = "Input2 is..."
    ghenv.Component.Params.Input[inputIndex].Optional = False
    inputIndex+=1
    
    #Outputs
    #--------------------------------------------------------------------------------------------
    outputIndex=0
    
    ghenv.Component.Params.Output[outputIndex].Name = "Index"
    ghenv.Component.Params.Output[outputIndex].NickName = "i"
    ghenv.Component.Params.Output[outputIndex].Description = "Output1 is..."
    outputIndex+=1

i = L.index(I)
# ---------- end itemindex ----------
zoom = Button()
geo = PreviewGeometry(sc=1)
panel_3 = Panel("""backslash
slash
q
p
J
L
s
z""")
item_2 = ListItem(List=panel_3, Index=itemindex, Wrap=True)
merge = Merge(Data1="front", Data2="front", Data3="side", Data4="side", Data5="front", Data6="front", Data7="side", Data8="side")
merge_2 = Merge(Data1="F", Data2="T", Data3="F", Data4="T", Data5="F", Data6="T", Data7="F", Data8="T")
merge_3 = Merge(Data1="back", Data2="back", Data3="back", Data4="back", Data5="side", Data6="side", Data7="side", Data8="side")
list = ValueList({"Back": "back", "Side": "side"}, selected="Back")
item_3 = ListItem(List=merge_3, Index=itemindex, Wrap=True)
toggle = BooleanToggle(False)
item_4 = ListItem(List=merge_2, Index=itemindex, Wrap=True)
list_2 = ValueList({"Front", "Side"}, selected="Front")
item_5 = ListItem(List=merge, Index=itemindex, Wrap=True)
expression = Expression(x=Slider(420, range=0..1000), Expression="x/100")
expression_2 = Expression(x=Slider(260, range=0..1000), Expression="x/100")
expression_3 = Expression(x=Slider(250, range=0..1000), Expression="x/100")
entrance = Text(item_3)
view = Text(item_5)
mirror = Boolean(item_4)
length_m = Number(expression)
height_m = Number(expression_3)
width_m = Number(expression_2)
panel_4 = Panel("""round
rectangular""")
panel_5 = Panel("""front
side""")
panel_6 = Panel("""back
side""")
_2d = _2D(x=length_m)
_2d_2 = _2D(x=width_m)
mirrored = Boolean(mirror)
itemindex_2 = ItemIndex(L=panel_6, I=entrance)  # -> i; inputs L: list; same code as itemindex
itemindex_3 = ItemIndex(L=panel_5, I=view)  # -> i; inputs L: list; same code as itemindex

panel_7 = Panel("The middle of the main entrance door of the upper entrance floor.")

rectangle = Rectangle(Plane=PlaneXY(0, 0, 0), XSize=_2d, YSize=_2d_2, Radius=0)  # -> Rectangle, Length
valueor0 = ValueOr0(value=itemindex_2)
valueor0_2 = ValueOr0(value=itemindex_3)
expression_4 = Expression(x=Slider(20, range=0..100), Expression="x/100")
expression_5 = Expression(x=Slider(25, range=0..100), Expression="x/100")
entrance_2 = Integer(valueor0)
entrance_3 = Integer(entrance_2)
multiplication = Multiplication(A=entrance_3, B="4")
view_2 = Integer(valueor0_2)
view_3 = Integer(view_2)
multiplication_2 = Multiplication(A=view_3, B="2")
addition = Addition(A=multiplication, B=multiplication_2, C=mirrored)
variant_3 = Integer(addition)
fillet_radius_m = Number(expression_5)
shellthickness_m = Number(expression_4)
subtraction = Subtraction(A=height_m, B=shellthickness_m)
neg = Negative(Value=shellthickness_m)
dom = ConstructDomain(DomainStart=neg, DomainEnd=subtraction)
box = DomainBox(Base=PlaneXY(0, 0, 0), X=_2d_2, Y=_2d, Z=dom)
volume1to500 = Box(box)
debrep = DeconstructBrep(Brep=volume1to500)  # -> Faces, Edges, Vertices
bool = Boolean(invert(mirror))
trim = TrimTree(Tree=debrep.Edges, Depth=1)
trim_2 = TrimTree(Tree=debrep.Faces, Depth=1)
filter = StreamFilter(Gate=entrance_2, Stream0=mirror, Stream1=bool)
item_6 = ListItem(List=trim_2, Index=0, Wrap=True)  # -> Item, Item1, Item2, Item3, Item4, Item5
# 2023-2025 Ueli Saluz
# 2025 Elduane Lumpine
# 2025 Christian Hödtke
# Permission is hereby granted, free of charge, to any person obtaining a copy
# of this Grasshopper file and associated documentation files (the "Document"),
# to deal in the Document without restriction, including without limitation the
# rights to use, copy, modify, merge, publish, distribute, sublicense, and/or sell
# copies of the Document, and to permit persons to whom the Document is
# furnished to do so.
# 
# Individual clusters used inside this document might be licensed under
# different terms. This is indicated through a similar copyright notice group
# inside the cluster and otherwise in the license field of the cluster. If you
# have any question please reach out to us: license@semio-tech.com
# 
# THE DOCUMENT IS PROVIDED "AS IS", WITHOUT WARRANTY OF ANY
# KIND, EXPRESS OR IMPLIED, INCLUDING BUT NOT LIMITED TO THE
# WARRANTIES OF MERCHANTABILITY, FITNESS FOR A PARTICULAR
# PURPOSE AND NONINFRINGEMENT. IN NO EVENT SHALL THE
# AUTHORS OR COPYRIGHT HOLDERS BE LIABLE FOR ANY CLAIM,
# DAMAGES OR OTHER LIABILITY, WHETHER IN AN ACTION OF
# CONTRACT, TORT OR OTHERWISE, ARISING FROM, OUT OF OR IN
# CONNECTION WITH THE DOCUMENT OR THE USE OR OTHER
# DEALINGS IN THE DOCUMENT.
list_3 = ValueList({"Round": "round", "Rectangular": "rectangular"}, selected="Round")

aut = ModelAuthor(Name="Ueli Saluz", Email="ueli@semio-tech.org")  # -> Author, Valid, Name, Email, Attributes

mirror_2 = Boolean(filter)
mirrored_2 = Boolean(mirror_2)
addition_2 = Addition(A=multiplication, B=multiplication_2, C=mirrored_2)
oldvariant = Integer(addition_2)

concat = Concatenate(FragmentA="images/", FragmentC=".png")

lng = ListLength(List=debrep.Edges)
series = Series(Start=0, Step=1, Count=lng)
trim_3 = TrimTree(Tree=series, Depth=1)
filedge = FilletEdge(Shape=volume1to500, Blend=0, Metric=0, Edges=trim_3, Radii=fillet_radius_m)
trim_4 = TrimTree(Tree=filedge, Depth=1)

expression_6 = Expression(x=Slider(30, range=0..100), Expression="x/100")
expression_7 = Expression(x=Slider(65, range=0..100), Expression="x/100")
window_shape = Text(list_3)
itemindex_4 = ItemIndex(L=panel_4, I=window_shape)  # -> i; inputs L: list; same code as itemindex
valueor0_3 = ValueOr0(value=itemindex_4)
windowshape = Integer(valueor0_3)
window_circle_radius_m = Number(expression_7)
window_offset_wall_m = Number(expression_6)
expression_8 = Expression(x=Slider(80, range=0..100), Expression="x/100")
expression_9 = Expression(x=Slider(200, range=0..1000), Expression="x/100")
expression_10 = Expression(x=Slider(25, range=0..100), Expression="x/100")
door_width_m = Number(expression_8)
door_offset_wall_m = Number(expression_10)
door_height_m = Number(expression_9)

item_7 = ListItem(List=trim, Index=0, Wrap=True)  # -> Item, Item1, Item2, Item3
flip = FlipCurve(Curve=item_7.Item)  # -> Curve, Flag
filter_2 = StreamFilter(Gate=mirror_2, Stream0=flip.Curve, Stream1=item_7.Item)
filter_3 = StreamFilter(Gate=mirror_2, Stream0=item_6.Item1, Stream1=item_6.Item3)
filter_4 = StreamFilter(Gate=entrance_2, Stream0=filter_2, Stream1=item_7.Item1)
filter_5 = StreamFilter(Gate=entrance_2, Stream0=item_6.Item, Stream1=filter_3)
addition_3 = Addition(A=door_offset_wall_m, B=shellthickness_m)
eval = EvaluateLength(Curve=filter_4, Length=addition_3, Normalized=False)  # -> Point, Tangent, Parameter
srf_cp = SurfaceClosestPoint(Point=eval.Point, Surface=filter_5)  # -> Point, UVPoint, Distance
evalsrf = EvaluateSurface(Surface=filter_5, Point=srf_cp.UVPoint)  # -> Point, Normal, UDirection, VDirection, Frame
neg_2 = Negative(Value=door_width_m)
filter_6 = StreamFilter(Gate=entrance_2, Stream0=neg_2, Stream1=door_width_m)
and_3 = GateAnd(A=entrance_2, B=mirror_2)
filter_7 = StreamFilter(Gate=mirror_2, Stream0=filter_6, Stream1=door_width_m)
filter_8 = StreamFilter(Gate=and_3, Stream0=filter_7, Stream1=neg_2)
rectangle_2 = Rectangle(Plane=evalsrf.Frame, XSize=filter_8, YSize=door_height_m, Radius=0)  # -> Rectangle, Length
Z = UnitZ(Factor=shellthickness_m)
move = Move(Geometry=rectangle_2.Rectangle, Motion=Z)  # -> Geometry, Transform
door = Rectangle(move.Geometry)

flip_2 = FlipCurve(Curve=item_7.Item1)  # -> Curve, Flag
expression_11 = Expression(x=height_m, Expression="x/2")
filter_9 = StreamFilter(Gate=mirror_2, Stream0=item_7.Item3, Stream1=flip_2.Curve)
addition_4 = Addition(A=window_circle_radius_m, B=window_offset_wall_m, C=shellthickness_m)
Z_2 = UnitZ(Factor=expression_11)
filter_10 = StreamFilter(Gate=mirror_2, Stream0=item_6.Item3, Stream1=item_6.Item1)
eval_2 = EvaluateLength(Curve=filter_9, Length=addition_4, Normalized=False)  # -> Point, Tangent, Parameter
evalsrf_2 = EvaluateSurface(Surface=reparameterize(filter_10), Point="0.5,0.5")  # -> Point, Normal, UDirection, VDirection, Frame
move_2 = Move(Geometry=eval_2.Point, Motion=Z_2)  # -> Geometry, Transform
evalsrf_3 = EvaluateSurface(Surface=reparameterize(item_6.Item2), Point="0.5,0.5")  # -> Point, Normal, UDirection, VDirection, Frame
pl_origin = PlaneOrigin(Base=evalsrf_2.Frame, Origin=move_2.Geometry)
expression_12 = Expression(x=window_circle_radius_m, Expression="x*2")
filter_11 = StreamFilter(Gate=view_2, Stream0=evalsrf_3.Frame, Stream1=pl_origin)
_2d_3 = _2D(x=expression_12)
rectangle_3 = Rectangle(Plane=filter_11, XSize=_2d_3, YSize=_2d_3, Radius=0)  # -> Rectangle, Length
cir = Circle(Plane=filter_11, Radius=window_circle_radius_m)
filter_12 = StreamFilter(Gate=windowshape, Stream0=cir, Stream1=rectangle_3.Rectangle)
windowplane = Plane(filter_11)
window = Geometry(filter_12)

windowplane_2 = Plane(windowplane)
deplane = DeconstructPlane(Plane=windowplane_2)  # -> Origin, XAxis, YAxis, ZAxis
expression_13 = Expression(x=shellthickness_m, Expression="x/3")
neg_3 = Negative(Value=deplane.ZAxis)
amp = Amplitude(Vector=neg_3, Amplitude=expression_13)
extr = Extrude(Base=window, Direction=amp)
cap = CapHoles(Brep=extr)

m2d_rhino = Make2DRhinoView(Clip=True)  # disabled
number_slider = Slider(876, range=0..1000)  # disabled

srf = Surface(item_6.Item)
srf_2 = Surface(item_6.Item1)
srf_3 = Surface(item_6.Item3)
srf_4 = Surface(item_6.Item2)
srf_5 = Surface(item_6.Item4)
srf_6 = Surface(item_6.Item5)
mirrored_3 = Boolean(mirror_2)
mirrored_4 = Boolean(mirror_2)
filter_13 = StreamFilter(Gate=mirrored_3, Stream0=srf_2, Stream1=srf_3)
filter_14 = StreamFilter(Gate=mirrored_4, Stream0=srf_3, Stream1=srf_2)
merge_4 = Merge(Data1=srf_2, Data2=srf_3)
merge_5 = Merge(Data1=srf_2, Data2=srf)
merge_6 = Merge(Data1=srf, Data2=srf_4)
merge_7 = Merge(Data1=srf_2, Data2=srf_4)
merge_8 = Merge(Data1=srf_3, Data2=srf_4)
merge_9 = Merge(Data1=srf, Data2=srf_3)
entrance_4 = Integer(entrance_2)
window_2 = Integer(view_2)
filter_15 = StreamFilter(Gate=entrance_4, Stream0=srf, Stream1=filter_13)
filter_16 = StreamFilter(Gate=window_2, Stream0=srf_4, Stream1=filter_14)
filter_17 = StreamFilter(
    Gate=oldvariant,
    Stream0=merge_4,
    Stream1=merge_4,
    Stream2=merge_7,
    Stream3=merge_8,
    Stream4=merge_9,
    Stream5=merge_5,
    Stream6=merge_6,
    Stream7=merge_6)

view_rectangle = ViewRectangle(view=m2d_rhino)  # disabled
previewplane = PreviewPlane(plane=view_rectangle, axis_length=number_slider)  # disabled
construction_area_factor = Number(Slider(0.2, range=0..1))
construction_cost_eff_m² = Number(Slider(9500, range=0..20000))
income_month_eff_m² = Number(Slider(125, range=0..200))
maintenance_expenses_month_eff_m² = Number(Slider(10, range=0..30))

door_2 = Rectangle(door)
explode = Explode(Curve=door, Recursive=True)  # -> Segments, Vertices
trim_5 = TrimTree(Tree=explode.Segments, Depth=1)
item_8 = ListItem(List=trim_5, Index=0, Wrap=True)  # -> Item, Item1, Item2, Item3
eval_3 = EvaluateCurve(Curve=reparameterize(item_8.Item), Parameter="0.5")  # -> Point, Tangent, Angle
rev = Reverse(Vector=eval_3.Tangent)
Z_3 = UnitZ(Factor=1)
xprod = CrossProduct(VectorA=eval_3.Tangent, VectorB=Z_3, Unitize=False)  # -> Vector, Length
xprod_2 = CrossProduct(VectorA=rev, VectorB=Z_3, Unitize=False)  # -> Vector, Length
pl = ConstructPlane(Origin=eval_3.Point, XAxis=eval_3.Tangent, YAxis=xprod_2.Vector)
doorentranceplane = Plane(pl)

panel_8 = Panel("""east
west""")
panel_9 = Panel("""west
east""")
panel_10 = Panel("An apartment capsule for one person. It has the entrance on the ")
item_9 = ListItem(List=panel_8, Index=mirror, Wrap=True)
item_10 = ListItem(List=panel_9, Index=mirror, Wrap=True)
concat_2 = Concatenate(FragmentA="door capsule", FragmentC=" ", FragmentB=item_9)
concat_3 = Concatenate(FragmentA="door tambour", FragmentC=" ", FragmentB=item_10)
filter_18 = StreamFilter(Gate=mirror, Stream1=" It is mirrored compared to the normal one.")
por = ModelPort(
    Validate=validate,
    Description=panel_7,
    Family=concat_2,
    CompatibleFamilies=concat_3,
    Point=eval_3.Point,
    Direction=xprod.Vector,
    Qualities="entrance")  # -> Port, Valid, Id, Description, Mandatory, Family, CompatibleFamilies, Point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
concat_4 = Concatenate(
    FragmentA=panel_10,
    FragmentB=entrance,
    FragmentC=" and has the view to the ",
    FragmentD=view,
    FragmentF=".",
    FragmentE=filter_18)

prv = PreviewPort(po=por.Port, sc=1)

doorentranceplane_2 = Plane(doorentranceplane)
deplane_2 = DeconstructPlane(Plane=doorentranceplane_2)  # -> Origin, XAxis, YAxis, ZAxis
amp_2 = Amplitude(Vector=deplane_2.YAxis, Amplitude=shellthickness_m)
extr_2 = Extrude(Base=door, Direction=amp_2)
cap_2 = CapHoles(Brep=extr_2)

merge_10 = Merge(Data1=cap_2, Data2=cap)
sdiff = SolidDifference(BrepsA=trim_4, BrepsB=merge_10)

rec = Rectangle({Plane=Plane(origin=(15.60693884, 14.69292436, 15.6245417), x=(0.7071067812, -0.7071067812, 0), y=(-0.4082482905, -0.4082482905, 0.8164965809)), Size=Domain2(u=-24.40970167..24.40970167, v=-18.06498235..18.06498235)})
m2d_parallel = Make2DParallelView(Projection=rec)
make2d = Make2D(Geometry=cap_2, View=m2d_parallel, TangentEdges=False, TangentSeams=False, AutoComputeMake2D=True)  # -> VisibleCurves, VisibleIndex, VisibleType, HiddenCurves, HiddenIndex, HiddenType
make2d_2 = Make2D(Geometry=cap, View=m2d_parallel, TangentEdges=False, TangentSeams=False, AutoComputeMake2D=True)  # -> VisibleCurves, VisibleIndex, VisibleType, HiddenCurves, HiddenIndex, HiddenType
make2d_3 = Make2D(Geometry=trim_4, View=m2d_parallel, TangentEdges="T", TangentSeams=False, AutoComputeMake2D=True)  # -> VisibleCurves, VisibleIndex, VisibleType, HiddenCurves, HiddenIndex, HiddenType
trim_6 = TrimTree(Tree=make2d_3.VisibleCurves, Depth=1)
trim_7 = TrimTree(Tree=make2d.VisibleCurves, Depth=1)
merge_11 = Merge(Data1=make2d_2.VisibleCurves, Data2=make2d_2.HiddenCurves)
trim_8 = TrimTree(Tree=merge_11, Depth=1)
shell = Geometry(trim_6)
door_3 = Geometry(trim_7)
window_3 = Geometry(trim_8)

volume1to200 = Brep(sdiff)
bbox = BoundingBox(Content=flatten(volume1to200), Plane=PlaneXY(0, 0, 0), UnionBox=True)  # -> Box, Box_2
zoom2bb = ZoomToBoundingBox(N=["Top", "Front", "Right", "Perspective", "Parallel"], BB=bbox.Box, S=0, R=zoom)  # -> F, SBB; inputs BB: Box, R: Boolean
# ---------- zoom2bb: Python ----------
#Component Information
#--------------------------------------------------------------------------------------------
if ghenv.Component.RunCount<2:
    #General
    #--------------------------------------------------------------------------------------------
    __author__ = "Ueli Saluz"
    __version__ = "2022.05.21"
    
    ghenv.Component.Name = "ZoomToBoundingBox"
    ghenv.Component.NickName = "Zoom2BB"
    ghenv.Component.Description = "Zoom the view of a Rhino viewport to a bounding box."
    ghenv.Component.Message = "VER 1.1"
    ghenv.Component.Category = "Display"
    ghenv.Component.SubCategory = "Camera"
    
     #Inputs
    #--------------------------------------------------------------------------------------------
    inputIndex=0
    
    ghenv.Component.Params.Input[inputIndex].Name = "Name"
    ghenv.Component.Params.Input[inputIndex].NickName = "N"
    ghenv.Component.Params.Input[inputIndex].Description = "Name of the viewport"
    ghenv.Component.Params.Input[inputIndex].Optional = False
    inputIndex+=1
    
    ghenv.Component.Params.Input[inputIndex].Name = "BoundingBox"
    ghenv.Component.Params.Input[inputIndex].NickName = "BB"
    ghenv.Component.Params.Input[inputIndex].Description = ""
    ghenv.Component.Params.Input[inputIndex].Optional = False
    inputIndex+=1
    
    ghenv.Component.Params.Input[inputIndex].Name = "ScaleFactor"
    ghenv.Component.Params.Input[inputIndex].NickName = "S"
    ghenv.Component.Params.Input[inputIndex].Description = "A factor for the extension of the bounding box." \
    +"0 means 0 extension, a positive number makes the bounding box larger a negative smaller. The amount is proportional to the length."
    ghenv.Component.Params.Input[inputIndex].Optional = False
    inputIndex+=1
   
    
    ghenv.Component.Params.Input[inputIndex].Name = "Run"
    ghenv.Component.Params.Input[inputIndex].NickName = "R"
    ghenv.Component.Params.Input[inputIndex].Description = "Zoom to the given bounding box."
    ghenv.Component.Params.Input[inputIndex].Optional = False
    inputIndex+=1
    
    #Outputs
    #--------------------------------------------------------------------------------------------
    outputIndex=0
    
    ghenv.Component.Params.Output[outputIndex].Name = "Finished"
    ghenv.Component.Params.Output[outputIndex].NickName = "F"
    ghenv.Component.Params.Output[outputIndex].Description = "Sends True when finished. Just to trigger other depending components."
    outputIndex+=1
    
    ghenv.Component.Params.Output[outputIndex].Name = "ScaledBoundingBox"
    ghenv.Component.Params.Output[outputIndex].NickName = "SBB"
    ghenv.Component.Params.Output[outputIndex].Description = "The scaled bounding box."
    outputIndex+=1


#Imports
#--------------------------------------------------------------------------------------------
from Rhino import RhinoDoc
from Rhino.Geometry import Box

#Solver - Run with trees to enhance performance drastically
#--------------------------------------------------------------------------------------------
if __name__ == "__main__":
    try:
        vp = RhinoDoc.ActiveDoc.Views.Find(N, False).ActiveViewport
        if R:
            box = BB
            bb = BB.BoundingBox
            bb.Inflate(S*box.X.Length,S*box.Y.Length,S*box.Z.Length)
            vp.ZoomBoundingBox(bb)
            SBB = bb
        F = True
    except:
        pass
# ---------- end zoom2bb ----------

expression_14 = Expression(y=shell, Expression="x")
expression_15 = Expression(y=window_3, Expression="x")
expression_16 = Expression(y=door_3, Expression="x")
merge_12 = Merge(Data1=expression_14, Data2=expression_16, Data3=expression_15)
merge_13 = Merge(Data1=shell, Data2=door_3, Data3=window_3)
concat_5 = Concatenate(FragmentC="icon")
concat_6 = Concatenate(FragmentC="icons", FragmentD=sep)
concat_7 = Concatenate(FragmentA=concat_6)
concat_8 = Concatenate(FragmentA=par, FragmentB=sep, FragmentC=concat_7)
blc = ExportBlock(path=concat_8, name=concat_5, url=concat_7, geo=merge_13, layer_name=merge_12, export=and_2)  # -> block_definition_3, path_4, exported_2

merge_14 = Merge(Data1=filter_15, Data2=filter_16)
merge_15 = Merge(Data1=door, Data2=window)
sdiff_2 = SolidDifference(BrepsA=merge_14, BrepsB=merge_15)
merge_16 = Merge(Data1=srf_5, Data2=filter_17, Data3=sdiff_2, Data4=srf_6)
shell_2 = Surface(merge_16)
heating_energy_demand_kwh_m²a = Number(Slider(45, range=0..200))
cooling_energy_demand_kwh_m²a = Number(Slider(30, range=0..200))
technical_equipment_energy_demand_kwh_m² = Number(Slider(30, range=0..200))  # "Technical Equipment Energy Demand[kWh/m²a]"
construction_global_warming_potential_kg = Number(Slider(1000, range=0..2000))  # "Construction Global Warming Potential [kgCO2e/eff. m²]"

# ----
# https://search.bsdd.buildingsmart.org/uri/buildingsmart/ifc/4.3/prop/Length
# https://search.bsdd.buildingsmart.org/uri/buildingsmart/ifc/4.3/prop/Width
# https://search.bsdd.buildingsmart.org/uri/buildingsmart/ifc/4.3/prop/Height
# 
# https://identifier.buildingsmart.org/uri/buildingsmart/ifc/4.3/prop/NetFloorArea
# 
# https://identifier.buildingsmart.org/uri/buildingsmart/ifc/4.3/prop/EnergyConsumption
# https://identifier.buildingsmart.org/uri/buildingsmart/ifc/4.3/prop/EnergyConsumption
# https://identifier.buildingsmart.org/uri/buildingsmart/ifc/4.3/prop/EnergyConsumption
# 
# 
# https://identifier.buildingsmart.org/uri/etim/etim/9.0/prop/EF016979
maintenance_expenses_month_eff_m²_2 = Number(maintenance_expenses_month_eff_m²)
# Outputs   ->
#                 |
#                 v
construction_global_warming_potential_kg_2 = Number(construction_global_warming_potential_kg)  # "Construction Global Warming Potential [kgCO2e/eff. m²]"
construction_area_factor_2 = Number(construction_area_factor)
technical_equipment_energy_demand_kwh_m²_2 = Number(technical_equipment_energy_demand_kwh_m²)  # "Technical Equipment Energy Demand[kWh/m²a]"
income_month_eff_m²_2 = Number(income_month_eff_m²)
heating_energy_demand_kwh_m²a_2 = Number(heating_energy_demand_kwh_m²a)
cooling_energy_demand_kwh_m²a_2 = Number(cooling_energy_demand_kwh_m²a)
construction_cost_eff_m²_2 = Number(construction_cost_eff_m²)
expression_17 = Expression(x=construction_area_factor_2, Expression="1-x")
area = Area(Geometry=rectangle.Rectangle)  # -> Area, Centroid
multiplication_3 = Multiplication(A=area.Area, B=expression_17)
multiplication_4 = Multiplication(A=multiplication_3, B=income_month_eff_m²_2)
multiplication_5 = Multiplication(A=multiplication_3, B=maintenance_expenses_month_eff_m²_2)
expression_18 = Expression(x=multiplication_4, Expression="x*12")
expression_19 = Expression(x=multiplication_5, Expression="x*12")
multiplication_6 = Multiplication(A=multiplication_3, B=construction_global_warming_potential_kg_2)
multiplication_7 = Multiplication(A=heating_energy_demand_kwh_m²a_2, B=multiplication_3)
multiplication_8 = Multiplication(A=cooling_energy_demand_kwh_m²a_2, B=multiplication_3)
multiplication_9 = Multiplication(A=multiplication_3, B=construction_cost_eff_m²_2)
multiplication_10 = Multiplication(A=technical_equipment_energy_demand_kwh_m²_2, B=multiplication_3)
roundmult = RoundToMultiple(N=multiplication_3, M="0.01")  # -> R; inputs N: tree, M: tree
# ---------- roundmult: Python ----------
#Component Information
#--------------------------------------------------------------------------------------------
if ghenv.Component.RunCount<2:
    #General
    #--------------------------------------------------------------------------------------------
    __author__ = "YOUR NAME"
    __version__ = "2000.00.00"
    
    ghenv.Component.Name = "Round to Multiple"
    ghenv.Component.NickName = "RoundMult"
    ghenv.Component.Description = "Rounds a number to the nearest specified multiple."
    ghenv.Component.Message = "VER 1.0"
    ghenv.Component.Category = "Math"
    ghenv.Component.SubCategory = "Arithmetic"
    
     #Inputs
    #--------------------------------------------------------------------------------------------
    inputIndex=0
    
    ghenv.Component.Params.Input[inputIndex].Name = "Number"
    ghenv.Component.Params.Input[inputIndex].NickName = "N"
    ghenv.Component.Params.Input[inputIndex].Description = "Number to round."
    ghenv.Component.Params.Input[inputIndex].Optional = False
    inputIndex+=1
    
    ghenv.Component.Params.Input[inputIndex].Name = "Multiple"
    ghenv.Component.Params.Input[inputIndex].NickName = "M"
    ghenv.Component.Params.Input[inputIndex].Description = "Multiple to round to."
    ghenv.Component.Params.Input[inputIndex].Optional = False
    inputIndex+=1
    
    #Outputs
    #--------------------------------------------------------------------------------------------
    outputIndex=0
    
    ghenv.Component.Params.Output[outputIndex].Name = "Rounded"
    ghenv.Component.Params.Output[outputIndex].NickName = "R"
    ghenv.Component.Params.Output[outputIndex].Description = "Number rounded to the nearest specified multiple."
    outputIndex+=1


#Imports
#--------------------------------------------------------------------------------------------
from System import Object
from Grasshopper import DataTree
import math


#The Component function - Business logic only (e.g. working without trees)
#--------------------------------------------------------------------------------------------
"""Function that this component is computing.
    Inputs:
        number: The number to round.
        multiple: The multiple to round to.
    Output:
        rounded: The number rounded to the nearest specified multiple."""
def RoundToMultiple(number, multiple):
    rounded = math.ceil(number / multiple) * multiple
    return rounded

#Solver - Run with trees to enhance performance drastically
#--------------------------------------------------------------------------------------------
if __name__ == "__main__":
    
    #Initialize trees
    #--------------------------------------------------------------------------------------------
    RoundedTree = DataTree[Object]()
    
    #Data matching
    #--------------------------------------------------------------------------------------------
    for path in N.Paths:
        numberBranch = N.Branch(path)
        for i, number in enumerate(numberBranch):
            multiple = M.Branch(path)[i]
            rounded = RoundToMultiple(number, multiple)
            RoundedTree.Add(rounded, path)
    
     #Assign trees to output
    #--------------------------------------------------------------------------------------------
    R = RoundedTree
# ---------- end roundmult ----------
round = Round(Number=multiplication_9)  # -> Nearest, Floor, Ceiling
roundmult_2 = RoundToMultiple(N=multiplication_6, M="0.01")  # -> R; inputs N: tree, M: tree; same code as roundmult
round_2 = Round(Number=multiplication_7)  # -> Nearest, Floor, Ceiling
round_3 = Round(Number=multiplication_8)  # -> Nearest, Floor, Ceiling
round_4 = Round(Number=multiplication_10)  # -> Nearest, Floor, Ceiling
round_5 = Round(Number=expression_18)  # -> Nearest, Floor, Ceiling
round_6 = Round(Number=expression_19)  # -> Nearest, Floor, Ceiling
merge_17 = Merge(
    Data1=entrance,
    Data2=view,
    Data3=length_m,
    Data4=width_m,
    Data5=height_m,
    Data6=window_shape,
    Data7=roundmult,
    Data8=round.Nearest,
    Data9=round_2.Nearest,
    Data10=round_3.Nearest,
    Data11=round_4.Nearest,
    Data12=round_5.Nearest,
    Data13=round_6.Nearest,
    Data14=roundmult_2)
panel_11 = Panel("""entrance
view
length
width
heigth
window shape
effective floor area
construction cost
heating energy demand
cooling energy demand
technical equipment energy demand
income
maintenance expenses
construction global warming potential""")
panel_12 = Panel(merge_17)
panel_13 = Panel("""m
m
m

m²
€
kWh/a
kWh/a
kWh/a
€/a
€/a
kgCO2e""")
qal = ModelQuality(Validate=validate, Name=panel_11, Value=panel_12, Unit=panel_13)  # -> Quality, Valid, Name, Value, Unit
filter_19 = StreamFilter(Gate=mirror, Stream1="mirrored")
merge_18 = Merge(Data1=qal.Quality, Data2=filter_19)

concat_9 = Concatenate(FragmentA="icons/", FragmentC=".svg")
typ = ModelType(
    Validate=validate,
    Name="Capsule",
    Description=concat_4,
    Icon=concat_9,
    Image=concat,
    Variant=variant_2,
    Unit="m",
    Ports=por.Port,
    Authors=aut.Author,
    Qualities=merge_18)  # -> Type, Valid, Name, Description, Icon, Image, Variant, Stock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
typ_2 = PutType(Type=typ.Type, Uri=par, Run=save)

typ_3 = SerializeType(Type=typ.Type)
txt = EncodeText(Text=typ_3, Mode=0)
type = Text(txt)
context_bake = ContextBake(Geometry=type)

jagged = SettingsSpeed()
mesh = MeshBrep(Brep=volume1to500, Settings=jagged)
collider = Mesh(mesh)

# ----
# Floor Layer 1
# walls = flächen layer 2
# windows  Layer 3
# doors rechteckig layer 4
# Shades Layer 5
# roof Layer 6
num = Number(amp_2)
volume = Data(trim_4)
num_2 = Number(amp_2)
doorentranceplane_3 = Plane(doorentranceplane)
neg_4 = Negative(Value=num)
neg_5 = Negative(Value=amp_2)
neg_6 = Negative(Value=num_2)
neg_7 = Negative(Value=amp_2)
roof = Data(srf_6)
base = Data(srf_5)
X = UnitX(Factor=window_circle_radius_m)
Z_4 = UnitZ(Factor=window_circle_radius_m)
extr_3 = Extrude(Base=window, Direction=neg_5)
extr_4 = Extrude(Base=window, Direction=neg_7)
offsetbox = OffsetBox(box=volume, length=neg_6)
deplane_3 = DeconstructPlane(Plane=doorentranceplane_3)  # -> Origin, XAxis, YAxis, ZAxis
door_4 = Surface(door)
debrep_2 = DeconstructBrep(Brep=filter_15)  # -> Faces, Edges, Vertices
deplane_4 = DeconstructPlane(Plane=filter_11)  # -> Origin, XAxis, YAxis, ZAxis
vec = VectorXYZ(XComponent=X, YComponent="0", ZComponent=Z_4)  # -> Vector, Length
cap_3 = CapHoles(Brep=extr_3)
cap_4 = CapHoles(Brep=extr_4)
amp_3 = Amplitude(Vector=deplane_3.YAxis, Amplitude="0.05")
item_11 = ListItem(List=debrep_2.Edges, Index=Slider(3, range=0..3), Wrap=True)  # -> Item, Item1
item_12 = ListItem(List=debrep_2.Vertices, Index=0, Wrap=True)
neg_8 = Negative(Value=vec.Vector)
extr_5 = Extrude(Base=door, Direction=amp_3)
merge_19 = Merge(Data1=cap_2, Data2=offsetbox, Data3=cap_4)
neg_9 = Negative(Value=amp_3)
move_3 = Move(Geometry=deplane_4.Origin, Motion=vec.Vector)  # -> Geometry, Transform
move_4 = Move(Geometry=deplane_4.Origin, Motion=neg_8)  # -> Geometry, Transform
pl_2 = ConstructPlane(Origin=item_12, XAxis=item_11.Item, YAxis=item_11.Item1)
cap_5 = CapHoles(Brep=extr_5)
join = BrepJoin(Breps=merge_19)  # -> Breps, Closed
rec_2pt = Rectangle2Pt(Plane=filter_11, PointA=move_3.Geometry, PointB=move_4.Geometry, Radius=0)  # -> Rectangle, Length
project = Project(Geometry=door_4, Plane=pl_2)  # -> flatten(Geometry), Transform
move_5 = Move(Geometry=cap_5, Motion=amp_3)  # -> Geometry, Transform
merge_20 = Merge(Data1=srf, Data2=srf_2, Data3=srf_3, Data4=srf_4)
walls = Data(merge_20)
merge_21 = Merge(Data1=walls, Data2=roof, Data3=base)
join_2 = BrepJoin(Breps=merge_21)  # -> Breps, Closed
offsetbox_2 = OffsetBox(box=join_2.Breps, length=neg_4)
merge_22 = Merge(Data1=cap_2, Data2=offsetbox_2, Data3=cap_3)
join_3 = BrepJoin(Breps=merge_22)  # -> Breps, Closed
sdiff_3 = SolidDifference(BrepsA=join_2.Breps, BrepsB=join_3.Breps)
move_6 = Move(Geometry=cap, Motion=neg_9)  # -> Geometry, Transform
window_4 = Surface(rec_2pt.Rectangle)
sdiff_4 = SolidDifference(BrepsA=volume, BrepsB=join_3.Breps)
group = NamedGroup(Geometry=srf_6, Name="roof")  # -> Group, Geometry, Name
group_2 = NamedGroup(Geometry=srf_5, Name="Base")  # -> Group, Geometry, Name
group_3 = NamedGroup(Geometry=merge_20, Name="walls")  # -> Group, Geometry, Name
group_4 = NamedGroup(Geometry=window_4, Name="window")  # -> Group, Geometry, Name
group_5 = NamedGroup(Geometry=project.Geometry, Name="door")  # -> Group, Geometry, Name
group_6 = NamedGroup(Geometry=move_6.Geometry, Name="window")  # -> Group, Geometry, Name
group_7 = NamedGroup(Geometry=move_5.Geometry, Name="door")  # -> Group, Geometry, Name
group_8 = NamedGroup(Geometry=move_5.Geometry, Name="door")  # -> Group, Geometry, Name
group_9 = NamedGroup(Geometry=sdiff_3, Name="shell")  # -> Group, Geometry, Name
group_10 = NamedGroup(Geometry=sdiff_4, Name="shell")  # -> Group, Geometry, Name
group_11 = NamedGroup(Geometry=move_6.Geometry, Name="window")  # -> Group, Geometry, Name
merge_23 = Merge(Data1=project.Geometry, Data2=window, Data3=join_2.Breps)
merge_24 = Merge(Data1=group_8.Group, Data2=group_9.Group, Data3=group_6.Group)
merge_25 = Merge(Data1=group_7.Group, Data2=group_10.Group, Data3=group_11.Group)
wires = BrepWireframe(Brep=merge_23, Density=-1)  # -> flatten(Wireframe)
group_12 = NamedGroup(Geometry=merge_24)  # -> Group, Geometry, Name
group_13 = NamedGroup(Geometry=merge_25)  # -> Group, Geometry, Name
merge_26 = Merge(Data1=join_2.Breps, Data2=wires)
data = Data(concat_4)
data_2 = Data(variant_2)
rep = ModelRepresentation(Tags="1 to 200")  # -> Representation, Valid, Url, Description, Tags, Attributes
collider_2 = Mesh(collider)
po = Port(por.Port)
au = Author(aut.Author)
ql = Quality(qal.Quality)
typ_4 = OppinionatedType(
    path=dir,
    na="Capsule",
    description=data,
    variant=data_2,
    de=group_12.Group,
    paper=merge_26,
    collider=collider_2,
    volume=group_12.Group,
    group=group_13.Group,
    rp=rep.Representation,
    po=po,
    authors=au,
    qualities=ql,
    ex=and)  # -> ty_2, ba_2

group_14 = NamedGroup(Geometry=join_2.Breps, Name="floors")  # -> Group, Geometry, Name

merge_27 = Merge(
    Data1=group_14.Group,
    Data2=group_2.Group,
    Data3=group_3.Group,
    Data4=group_4.Group,
    Data5=group_5.Group,
    Data7=group.Group)
group_15 = NamedGroup(Geometry=merge_27)  # -> Group, Geometry, Name
energy_representation = Data(group_15.Group)

# ==== cluster _2D
x = ClusterInput()
expression = Expression(x=x, Expression="x/2")
neg = Negative(Value=expression)
dom = ConstructDomain(DomainStart=neg, DomainEnd=expression)
I = ClusterOutput(dom)

# ==== cluster ValueOr0
value = ClusterInput()
value_2 = Number(value)
null = NullItem(Item=value_2)  # -> NullFlags, InvalidFlags, Description
filter = StreamFilter(Gate=null.NullFlags, Stream0=value_2, Stream1="0")
valueor0 = Number(filter)
valueor0_2 = ClusterOutput(valueor0)

# ==== cluster PreviewPlane: Preview a plane with axis colors and naming.
axis_length = ClusterInput()
plane = ClusterInput()
axis_length_2 = Number(axis_length)
plane_2 = Plane(plane)
deplane = DeconstructPlane(Plane=plane_2)  # -> Origin, XAxis, YAxis, ZAxis
line = LineSDL(Start=deplane.Origin, Direction=deplane.YAxis, Length=axis_length_2)
line_2 = LineSDL(Start=deplane.Origin, Direction=deplane.XAxis, Length=axis_length_2)
line_3 = LineSDL(Start=deplane.Origin, Direction=deplane.ZAxis, Length=axis_length_2)
swatch = ColourSwatch(SwatchColor=RGB(235, 52, 79))
swatch_2 = ColourSwatch(SwatchColor=RGB(0, 166, 157))
swatch_3 = ColourSwatch(SwatchColor=RGB(240, 117, 24))
end = EndPoints(Curve=line_2)  # -> Start, End
end_2 = EndPoints(Curve=line)  # -> Start, End
end_3 = EndPoints(Curve=line_3)  # -> Start, End
tag = TextTag(Location=end.End, Text="X", Colour=swatch)
tag_2 = TextTag(Location=end_2.End, Text="Y", Colour=swatch_2)
tag_3 = TextTag(Location=end_3.End, Text="Z", Colour=swatch_3)
preview = CustomPreview(Geometry=line_2, Material=swatch)
preview_2 = CustomPreview(Geometry=line, Material=swatch_2)
preview_3 = CustomPreview(Geometry=line_3, Material=swatch_3)

# ==== cluster ViewRectangle
view = ClusterInput()
view_2 = Data(view)
nickname = NAME(view=view_2)  # -> c, x, y, z, h, w
# ---------- nickname: Python ----------
uselss, c, x, y, z = view.GetCameraFrame()
h = view.FrustumHeight
w = view.FrustumWidth
# ---------- end nickname ----------
rev = Reverse(Vector=nickname.x)
rev_2 = Reverse(Vector=nickname.y)
pl = ConstructPlane(Origin=nickname.c, XAxis=rev, YAxis=nickname.y)
_2d = _2D(x=nickname.w)
_2d_2 = _2D(x=nickname.h)
rectangle = Rectangle(Plane=pl, XSize=_2d, YSize=_2d_2, Radius=0)  # -> Rectangle, Length
rec = Rectangle(rectangle.Rectangle)
rec_2 = ClusterOutput(rec)

# ==== cluster ExportBlock: Export geometry with layer names to a file.
path = ClusterInput()
name = ClusterInput()
url = ClusterInput()
geo = ClusterInput()
layer_name = ClusterInput()
export = ClusterInput()
path_2 = FilePath(path)
name_2 = Text(name)
url_2 = Text(url)
geo_2 = Geometry(geo)
layer_name_2 = Text(layer_name)
export_2 = Boolean(export)
layer = ModelLayer(Name=layer_name_2)  # -> Layer, Name, Hidden, Locked, DisplayColour, Material, Linetype
object = ModelObject(Geometry=geo_2, Layer=layer.Layer)  # -> Object, Geometry, Name, Layer, Visibility, Display, Drafting, Render
block_definition = ModelBlockDefinition(Objects=object.Object, Name=name_2, URL=url_2)  # -> BlockDefinition, Objects, Units, Name, Notes, URL, URLDescription
export_definition = ExportModelBlockDefinition(BlockDefinition=block_definition.BlockDefinition, FilePath=path_2, Overwrite="T", Export=export_2)  # -> BlockDefinition, FilePath, Exported
block_definition_2 = ModelBlockDefinition(export_definition.BlockDefinition)
path_3 = FilePath(export_definition.FilePath)
exported = Boolean(export_definition.Exported)
path_4 = ClusterOutput(path_3)
exported_2 = ClusterOutput(exported)
block_definition_3 = ClusterOutput(block_definition_2)

# ==== cluster PreviewGeometry: Preview geometry by ungrouping everything, showing light surfaces and dark edges.
sc = ClusterInput()
geo = ClusterInput()
geo_2 = Geometry(flatten(geo))
sc_2 = Number(sc)
expression = Expression(x=sc_2, Expression="x+1")
swatch = ColourSwatch(SwatchColor=RGB(0, 0, 0))
swatch_2 = ColourSwatch(SwatchColor=RGB(255, 255, 255))
ungroup = Ungroup(Group=geo_2)
ungroup_2 = Ungroup(Group=ungroup)
ungroup_3 = Ungroup(Group=ungroup_2)
ungroup_4 = Ungroup(Group=ungroup_3)
log = Logarithm(Value=expression)
clean = CleanTree(RemoveNulls=True, RemoveInvalid=True, RemoveEmpty=invert(False), Tree=ungroup_4)  # -> flatten(Tree)
multiplication = Multiplication(A=log, B=Slider(0.05, range=0..1))
linetype = ModelLinetype(Name="semio", Width=multiplication)  # -> ModelLinetype, Name, Segments, CapStyle, JoinStyle, Width, WidthUnits, TaperWidths, TaperPositions
dispatch = CSharpScript(D=clean)  # -> P, C, B, M, R
# ---------- dispatch: C# ----------
// Grasshopper Script Instance
#region Usings
using System;
using System.Linq;
using System.Collections;
using System.Collections.Generic;
using System.Drawing;

using Rhino;
using Rhino.Geometry;

using Grasshopper;
using Grasshopper.Kernel;
using Grasshopper.Kernel.Data;
using Grasshopper.Kernel.Types;
#endregion

public class Script_Instance : GH_ScriptInstance
{
    #region Notes
    /* 
      Members:
        RhinoDoc RhinoDocument
        GH_Document GrasshopperDocument
        IGH_Component Component
        int Iteration

      Methods (Virtual & overridable):
        Print(string text)
        Print(string format, params object[] args)
        Reflect(object obj)
        Reflect(object obj, string method_name)
    */
    #endregion

    private void RunScript(
	object D,
	ref object P,
	ref object C,
	ref object B,
	ref object M,
	ref object R)
    {
        if (D is Curve) C = D; // Curve
        else if (
            D is Rhino.Geometry.Point ||
            D is PointCloud
            )
            P = D; // Point
        else if ( D is Mesh) M = D; // Mesh
        else if (
            D is Surface ||
            D is Extrusion ||
            D is SubD ||
            D is Brep
            )
            B = D; // Brep
        else R = D; // Rest
            
    }
}
# ---------- end dispatch ----------
clean_2 = CleanTree(RemoveNulls=True, RemoveInvalid=True, RemoveEmpty=False, Tree=dispatch.M)
clean_3 = CleanTree(RemoveNulls=True, RemoveInvalid=True, RemoveEmpty=False, Tree=dispatch.R)
clean_4 = CleanTree(RemoveNulls=True, RemoveInvalid=True, RemoveEmpty=False, Tree=dispatch.B)
clean_5 = CleanTree(RemoveNulls=True, RemoveInvalid=True, RemoveEmpty=False, Tree=dispatch.P)
clean_6 = CleanTree(RemoveNulls=True, RemoveInvalid=True, RemoveEmpty=False, Tree=dispatch.C)
debrep = DeconstructBrep(Brep=clean_4)  # -> Faces, Edges, Vertices
preview = CustomPreview(Geometry=flatten(clean_5), Material=swatch)
preview_2 = CustomPreview(Geometry=flatten(debrep.Faces), Material=swatch_2)
preview_3 = CustomPreview(Geometry=flatten(clean_2), Material=swatch_2)
preview_4 = CustomPreview(Geometry=flatten(clean_3), Material=swatch)
curve_preview = CustomCurvePreview(Curve=clean_6, Linetype=linetype.ModelLinetype, Colour=swatch)
curve_preview_2 = CustomCurvePreview(Curve=debrep.Edges, Linetype=linetype.ModelLinetype, Colour=swatch)

# ==== cluster PreviewPort: Preview a port by showing the point and direction and if exists: id, family and compatible families.
po = ClusterInput()
sc = ClusterInput()
sc_2 = Number(sc)
po_2 = Port(po)
por = ModelPort(Port=po_2)  # -> Port, Valid, Id, Description, Mandatory, Family, CompatibleFamilies, Point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
swatch = ColourSwatch(SwatchColor=RGB(235, 52, 79))
swatch_2 = ColourSwatch(SwatchColor=RGB(250, 149, 0))
amp = Amplitude(Vector=por.Direction, Amplitude=sc_2)
lng = ListLength(List=por.CompatibleFamilies)
expression = Expression(x=por.Family, Expression="x=\"\"")
cull = CullPattern(List=por.Point, CullPattern=expression)
expression_2 = Expression(x=lng, Expression="x=0")
join = TextJoin(Text=por.CompatibleFamilies, Join=",")
expression_3 = Expression(x=sc_2, Expression="x+1")
merge = Merge(Data1=":")
trim = TrimTree(Tree=join, Depth=1)
trim_2 = TrimTree(Tree=expression_2, Depth=1)
log = Logarithm(Value=expression_3)
item = ListItem(List=merge, Index=expression, Wrap=invert(True))
concat = Concatenate(FragmentA="[", FragmentB=trim, FragmentC="]")
expression_4 = Expression(y=trim_2, Expression="x")
merge_2 = Merge(Data1=graft(concat), Data2=graft(expression_4))
item_2 = ListItem(List=merge_2, Index=graft(expression), Wrap=invert(True))
multiplication = Multiplication(A=log, B=Slider(2, range=0..10))
trim_3 = TrimTree(Tree=item_2, Depth=1)
concat_2 = Concatenate(FragmentA=por.Id, FragmentB=item, FragmentC=por.Family, FragmentD=trim_3)
preview = CustomPreview(Geometry=cull, Material=swatch)
tag = TextTag(Location=por.Point, Text=concat_2, Colour=swatch)
vdisex = VectorDisplayEx(Point=por.Point, Vector=amp, Colour=ColourSwatch(SwatchColor=RGB(0, 166, 157)), Width=multiplication)

# ==== cluster OppinionatedType: Construct a type following the oppinionated conventions of semio. All representations are saved under representations folder where each representation is saved once natively (.3dm) and once exported (.glb). Further a collider representation is required. All names and file names are standardized.
emoji = Panel("")
name = Panel("Default")
abbreviation = Panel("Dft?")
nn = Panel("De")
prm = ModelParam(Na=name, NN=nn, Dc="The optional default representation geometry group.", Op=Toggle(True), Ru=Toggle(True))  # -> Param, Name, NickName, Description, Optional, Success; inputs Pr: tree, Op: Boolean, Ru: Boolean
# ---------- prm: Python ----------
#Component Information
#--------------------------------------------------------------------------------------------
if ghenv.Component.RunCount<2:
    #General
    #--------------------------------------------------------------------------------------------
    __author__ = "Ueli Saluz"
    __version__ = "2025.06.18"
    
    ghenv.Component.Name = "Model Param"
    ghenv.Component.NickName = "~Prm"
    ghenv.Component.Description = "Deconstruct or modify a param."
    ghenv.Component.Message = "VER 1.0"
    ghenv.Component.Category = "semio"
    ghenv.Component.SubCategory = "Scripting"
    
     #Inputs
    #--------------------------------------------------------------------------------------------
    inputIndex=0
    
    ghenv.Component.Params.Input[inputIndex].Name = "Param"
    ghenv.Component.Params.Input[inputIndex].NickName = "Pr"
    ghenv.Component.Params.Input[inputIndex].Description = "Connect the param to desconstruct or modify here with one wire."
    ghenv.Component.Params.Input[inputIndex].Optional = False
    inputIndex+=1

    ghenv.Component.Params.Input[inputIndex].Name = "Name"
    ghenv.Component.Params.Input[inputIndex].NickName = "Na"
    ghenv.Component.Params.Input[inputIndex].Description = "Name of the param."
    ghenv.Component.Params.Input[inputIndex].Optional = False
    inputIndex+=1
    
    ghenv.Component.Params.Input[inputIndex].Name = "NickName"
    ghenv.Component.Params.Input[inputIndex].NickName = "NN"
    ghenv.Component.Params.Input[inputIndex].Description = "Nickname of the param."
    ghenv.Component.Params.Input[inputIndex].Optional = False
    inputIndex+=1
    
    ghenv.Component.Params.Input[inputIndex].Name = "Description"
    ghenv.Component.Params.Input[inputIndex].NickName = "Dc"
    ghenv.Component.Params.Input[inputIndex].Description = "Description of the param."
    ghenv.Component.Params.Input[inputIndex].Optional = True
    inputIndex+=1
    
    ghenv.Component.Params.Input[inputIndex].Name = "Optional"
    ghenv.Component.Params.Input[inputIndex].NickName = "Op"
    ghenv.Component.Params.Input[inputIndex].Description = "Wheather the param is optional."
    ghenv.Component.Params.Input[inputIndex].Optional = True
    inputIndex+=1
    
    ghenv.Component.Params.Input[inputIndex].Name = "Run"
    ghenv.Component.Params.Input[inputIndex].NickName = "Ru"
    ghenv.Component.Params.Input[inputIndex].Description = "Modify the param."
    ghenv.Component.Params.Input[inputIndex].Optional = True
    inputIndex+=1
    
    #Outputs
    #--------------------------------------------------------------------------------------------
    outputIndex=0
    
    ghenv.Component.Params.Output[outputIndex].Name = "Param"
    ghenv.Component.Params.Output[outputIndex].NickName = "Param"
    ghenv.Component.Params.Output[outputIndex].Description = "The desconstruct or modified param"
    ghenv.Component.Params.Output[outputIndex].Optional = False
    outputIndex+=1
    
    ghenv.Component.Params.Output[outputIndex].Name = "Name"
    ghenv.Component.Params.Output[outputIndex].NickName = "Name"
    ghenv.Component.Params.Output[outputIndex].Description = "Name of the param."
    ghenv.Component.Params.Output[outputIndex].Optional = False
    outputIndex+=1
    
    ghenv.Component.Params.Output[outputIndex].Name = "NickName"
    ghenv.Component.Params.Output[outputIndex].NickName = "NickName"
    ghenv.Component.Params.Output[outputIndex].Description = "Nickname of the param."
    ghenv.Component.Params.Output[outputIndex].Optional = False
    outputIndex+=1
    
    ghenv.Component.Params.Output[outputIndex].Name = "Description"
    ghenv.Component.Params.Output[outputIndex].NickName = "Description"
    ghenv.Component.Params.Output[outputIndex].Description = "Description of the param."
    ghenv.Component.Params.Output[outputIndex].Optional = True
    outputIndex+=1
    
    ghenv.Component.Params.Output[outputIndex].Name = "Optional"
    ghenv.Component.Params.Output[outputIndex].NickName = "Optional"
    ghenv.Component.Params.Output[outputIndex].Description = "Wheather the param is optional."
    ghenv.Component.Params.Output[outputIndex].Optional = True
    outputIndex+=1
    
    ghenv.Component.Params.Output[outputIndex].Name = "Success"
    ghenv.Component.Params.Output[outputIndex].NickName = "Success"
    ghenv.Component.Params.Output[outputIndex].Description = "Wheather the operation was successful."
    ghenv.Component.Params.Output[outputIndex].Optional = False
    outputIndex+=1

input = ghenv.Component.Params.Input[0]
param = input.Sources[0]
if Ru:
    if Na:
        param.Name = Na
    if NN:
        param.NickName = NN
    if Dc:
        param.Description = Dc
    if Op:
        param.Optional = Op
    Success = True
else:
    Success = False
Param = param
Name = param.Name
NickName = param.NickName
Description = param.Description
Optional = param.Optional
# ---------- end prm ----------
concat = Concatenate(FragmentA="\"", FragmentB=prm.Description, FragmentC="\"")
merge = Merge(Data1=emoji, Data2=prm.NickName, Data3=abbreviation, Data4=prm.Name, Data5=concat)
join = TextJoin(Text=merge, Join=",")
de = ClusterInput()
paper = ClusterInput()
panel = Panel(join)
path = ClusterInput()
na = ClusterInput()
description = ClusterInput()
variant = ClusterInput()
rp = ClusterInput()
collider = ClusterInput()
volume = ClusterInput()
ex = ClusterInput()
group = ClusterInput()
po = ClusterInput()
authors = ClusterInput()
qualities = ClusterInput()
sep = Separator()  # -> S; same code as sep
path_2 = FilePath(path)
na_2 = Name(na)
description_2 = Description(description)
variant_2 = Variant(variant)
de_2 = Default(de)
rp_2 = Representation(rp)
volume_2 = Volume(volume)
group_2 = Group(group)
paper_2 = Paper(paper)
collider_2 = Collider(collider)
authors_2 = Authors(authors)
qualities_2 = Qualities(qualities)
po_2 = Port(po)
ex_2 = Export(ex)
merge_2 = Merge(Data1=de_2, Data2=paper_2, Data3=collider_2, Data4=volume_2)
rep = ModelRepresentation(Representation=rp_2)  # -> Representation, Valid, Url, Description, Tags, Qualities
rep_2 = ReplaceText(Text=variant_2, Find="/", Replace="slash", RecursiveReplace=False)
txt = NormalizeText(Text=na_2)  # -> Strict, Title, Underscore, Kebab, Pascal
split = SplitList(List=rep.Tags, Index="1")  # -> ListA, ListB
rep_3 = ReplaceText(Text=rep_2, Find="\", Replace="backslash", RecursiveReplace=False)
panel_2 = Panel(rp_2)
txt_2 = NormalizeText(Text=rep_3)  # -> Strict, Title, Underscore, Kebab, Pascal
join_2 = TextJoin(Text=split.ListB, Join="_")
panel_3 = Panel("""default
paper
collider
volume""")
concat_2 = Concatenate(FragmentA=txt.Kebab, FragmentD="_", FragmentB=txt_2.Kebab)
concat_3 = Concatenate(FragmentA="images", FragmentB=sep, FragmentC=concat_2, FragmentD=".png")
concat_4 = Concatenate(FragmentA="icons", FragmentB=sep, FragmentC=concat_2, FragmentD=".svg")
concat_5 = Concatenate(FragmentA=concat_2, FragmentB=".glb")
concat_6 = Concatenate(FragmentA=concat_2, FragmentD="_", FragmentB=join_2)
concat_7 = Concatenate(FragmentA="representations", FragmentB=sep, FragmentC=concat_2, FragmentD=".glb")
concat_8 = Concatenate(FragmentA="representations", FragmentB=sep, FragmentC=concat_2, FragmentD=".3dm")
concat_9 = Concatenate(FragmentA=concat_6, FragmentB=".glb")
concat_10 = Concatenate(FragmentA=concat_6, FragmentB=".3dm")
concat_11 = Concatenate(FragmentD=concat_2, FragmentC="_", FragmentA=panel_3, FragmentB=".3dm")
concat_12 = Concatenate(FragmentA=concat_2, FragmentC="_", FragmentB=panel_3, FragmentD=".glb")
concat_13 = Concatenate(FragmentA="representations", FragmentB=sep, FragmentC=concat_10)
concat_14 = Concatenate(FragmentA="representations", FragmentB=sep, FragmentC=concat_9)
concat_15 = Concatenate(FragmentA="representations", FragmentB=sep, FragmentC=concat_11)
concat_16 = Concatenate(FragmentA="representations", FragmentB=sep, FragmentC=concat_12)
panel_4 = Panel(concat_13)
rep_4 = ModelRepresentation(Url=concat_13, Tags=split.ListB)  # -> Representation, Valid, Url, Description, Tags, Qualities
rep_5 = ModelRepresentation(Url=graft(concat_16), Tags=graft(panel_3))  # -> Representation, Valid, Url, Description, Tags, Qualities
rep_6 = ModelRepresentation(Url=concat_14, Tags=split.ListB)  # -> Representation, Valid, Url, Description, Tags, Qualities
rep_7 = ModelRepresentation(Url=graft(concat_15), Tags=graft(panel_3))  # -> Representation, Valid, Url, Description, Tags, Qualities
rep_8 = ModelRepresentation(Url=concat_7)  # -> Representation, Valid, Url, Description, Tags, Qualities
rep_9 = ModelRepresentation(Url=concat_8)  # -> Representation, Valid, Url, Description, Tags, Qualities
trim = TrimTree(Tree=rep_4.Representation, Depth=1)
trim_2 = TrimTree(Tree=rep_6.Representation, Depth=1)
trim_3 = TrimTree(Tree=rep_7.Representation, Depth=1)
trim_4 = TrimTree(Tree=rep_5.Representation, Depth=1)
merge_3 = Merge(Data1=rep_8.Representation, Data2=rep_9.Representation, Data3=trim, Data4=trim_2, Data5=trim_4, Data6=trim_3)
concat_17 = Concatenate(FragmentA=path_2, FragmentB=sep, FragmentC=concat_16)
concat_18 = Concatenate(FragmentA=path_2, FragmentB=sep, FragmentC=concat_14)
concat_collider_glb = Concatenate(FragmentA=path_2, FragmentB=sep, FragmentC=concat_16)
cluster = Cluster(gr=merge_2)  # -> geo_2, txt_2
typ = ModelType(
    Name=txt.Title,
    Description=description_2,
    Icon=concat_4,
    Image=concat_3,
    Variant=variant_2,
    Representations=merge_3,
    Ports=po_2,
    Authors=authors_2,
    Qualities=qualities_2)  # -> Type, Valid, Name, Description, Icon, Image, Variant, Stock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
geo = ExportGeometry(F=concat_collider_glb, G=collider_2, R=ex_2)  # -> S; inputs G: tree of GeometryBase, R: Boolean
# ---------- geo: C# ----------
// Grasshopper Script Instance
#region Usings
using System;
using System.Linq;
using System.Collections;
using System.Collections.Generic;
using System.Drawing;
using System.IO;

using Rhino;
using Rhino.Geometry;

using Grasshopper;
using Grasshopper.Kernel;
using Grasshopper.Kernel.Data;
using Grasshopper.Kernel.Types;
#endregion

public class Script_Instance : GH_ScriptInstance
{
    #region Notes
    /* 
      Members:
        RhinoDoc RhinoDocument
        GH_Document GrasshopperDocument
        IGH_Component Component
        int Iteration

      Methods (Virtual & overridable):
        Print(string text)
        Print(string format, params object[] args)
        Reflect(object obj)
        Reflect(object obj, string method_name)
    */
    #endregion

    private void RunScript(object F, DataTree<GeometryBase> G, bool R, ref object S)
    {
        // inspired from https://github.com/jhorikawa/GrasshopperProgrammingTutorials/blob/master/0015%20Export%20Geometry%20with%20Grasshopper%20C%23/Export%20Geometry%20with%20Grasshopper%20C%23.gh
        if(R){
            var guids = new List<Guid>();

            for(int i = 0; i < G.BranchCount; i++){
                for(int n = 0; n < G.Branches[i].Count; n++){
                var geom = G.Branches[i][n];
                var guid = Rhino.RhinoDoc.ActiveDoc.Objects.Add(geom);
                guids.Add(guid);
                }
            }

            Rhino.RhinoDoc.ActiveDoc.Objects.Select(guids);

            string cmd = "_-Export " + "\"" + F + "\"" + " _Enter _Enter";

            Rhino.RhinoApp.RunScript(cmd, false);

            Rhino.RhinoDoc.ActiveDoc.Objects.Delete(guids, true);
            S = true;
        }
    }
}
# ---------- end geo ----------
concat_3dm = Concatenate(FragmentA=path_2, FragmentB=sep, FragmentC=concat_13)
geo_2 = ExportGeometry(F=concat_18, G=collider_2, R=ex_2)  # -> S; inputs G: tree of GeometryBase, R: Boolean; same code as geo
geo_3 = ExportGeometry(F=concat_17, G=cluster.geo_2, R=ex_2)  # -> S; inputs G: tree of GeometryBase, R: Boolean; same code as geo
geo_4 = ExportGeometry()  # -> S; inputs G: tree of GeometryBase, R: Boolean; same code as geo
ty = Type(typ.Type)
ba = Text(concat_2)
ty_2 = ClusterOutput(ty)
ba_2 = ClusterOutput(ba)
blc = ExportBlock_3(export=ex_2, ob=group_2)  # -> block_definition_3, path_4, exported_2
blc_2 = ExportBlock_2(path=path_2, gr=group_2, ty=typ.Type, rp=rp_2, export=ex_2)  # -> block_definition_3, path_4, exported_2
blc_3 = ExportBlock_2(path=path_2, export=ex_2)  # -> block_definition_3, path_4, exported_2
geo_5 = ExportGeometry(F=concat_3dm, G=group_2, R=ex_2)  # -> S; inputs G: tree of GeometryBase, R: Boolean; same code as geo

# ==== cluster OffsetBox: Offset a box by a certain length.
length = ClusterInput()
box = ClusterInput()
length_2 = Number(length)
box_2 = Box(box)
debox = DeconstructBox(Box=box_2)  # -> Plane, X, Y, Z
cluster = D(I=debox.X, length=length_2)
cluster_2 = D(I=debox.Y, length=length_2)
cluster_3 = D(I=debox.Z, length=length_2)
box_3 = DomainBox(Base=debox.Plane, X=cluster, Y=cluster_2, Z=cluster_3)
adjust_box = Box(box_3)
adjust_box_2 = ClusterOutput(adjust_box)

# ==== cluster ExportBlock_2: Export geometry with layer names to a file.
gr = ClusterInput()
ty = ClusterInput()
export = ClusterInput()
rp = ClusterInput()
path = ClusterInput()
path_2 = FilePath(path)
ty_2 = Type(ty)
rp_2 = Representation(rp)
export_2 = Boolean(export)
cluster = Cluster(gr=gr)  # -> geo_2, txt_2
layer = ModelLayer(Name=cluster.txt_2)  # -> Layer, Name, Hidden, Locked, DisplayColour, Material, Linetype
object = ModelObject(Geometry=cluster.geo_2, Layer=layer.Layer)  # -> Object, Geometry, Name, Layer, Visibility, Display, Drafting, Render
typ = ModelType(Type=ty_2)  # -> Type, Valid, Name, Description, Icon, Image, Variant, Stock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
rep = ModelRepresentation(Representation=rp_2)  # -> Representation, Valid, Url, Description, Tags, Qualities
trim = TrimTree(Tree=object.Object, Depth="5")
concat = Concatenate(FragmentA=typ.Type, FragmentC=":", FragmentB=rep.Representation)
block_definition = ModelBlockDefinition(Objects=trim, Name=concat, Notes=typ.Description)  # -> BlockDefinition, Objects, Units, Name, Notes, URL, URLDescription
export_definition = ExportModelBlockDefinition(BlockDefinition=block_definition.BlockDefinition, FilePath=path_2, Overwrite="T", Export=export_2)  # -> BlockDefinition, FilePath, Exported
block_definition_2 = ModelBlockDefinition(export_definition.BlockDefinition)
path_3 = FilePath(export_definition.FilePath)
exported = Boolean(export_definition.Exported)

# ---- group: Export single files. WIP
sep = Separator()  # -> S
# ---------- sep: C# ----------
#region Usings
using System;
using System.Linq;
using System.Collections;
using System.Collections.Generic;
using System.Drawing;
using System.IO;

using Rhino;
using Rhino.Geometry;

using Grasshopper;
using Grasshopper.Kernel;
using Grasshopper.Kernel.Data;
using Grasshopper.Kernel.Types;
#endregion

public class Script_Instance : GH_ScriptInstance
{
    private void RunScript(ref object S)
    {
        S = Path.DirectorySeparatorChar;
    }
}
# ---------- end sep ----------
rep_2 = ReplaceText(Text=rep.Url, Find="/", Replace=sep, RecursiveReplace=False)
item = ListItem(List=rep.Tags, Index=0, Wrap=True)
concat_2 = Concatenate(FragmentA=path_2, FragmentB=sep, FragmentC=rep_2)
mime = Mime({".glb": "model/gltf-binary", ".gltf": "model/gltf+json", ".stl": "model/stl", ".obj": "model/obj", ".blend": "model/x-blender", ".3dm": "model/vnd.3dm", ".ifc": "model/x-ifc", ".dwg": "model/acad", ".dxf": "model/dxf", ".rvt": "model/vnd.revit"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}, selected=".3dm")
trim_2 = TrimTree(Tree=item, Depth=1)
expression = Expression(x=trim_2, y=mime, Expression="x=y")
# WIP
dispatch = Dispatch(List=concat_2, DispatchPattern=expression)  # -> ListA, ListB
dispatch_2 = Dispatch(List=concat_2, DispatchPattern=expression)  # -> ListA, ListB

# ----
exported_2 = ClusterOutput(exported)
path_4 = ClusterOutput(path_3)
block_definition_3 = ClusterOutput(block_definition_2)

# ==== cluster ExportBlock_3: Export geometry with layer names to a file.
ob = ClusterInput()
G = ClusterInput()
dc = ClusterInput()
path = ClusterInput()
name = ClusterInput()
url = ClusterInput()
layer_n = ClusterInput()
export = ClusterInput()
ob_2 = ModelObject(ob)
group = Group(Geometry=G)
path_2 = FilePath(path)
name_2 = Text(name)
url_2 = Text(url)
export_2 = Boolean(export)
layer_n_2 = Name(layer_n)
dc_2 = DisplayColour(dc)
object = ModelObject(Object=group)  # -> Object, Geometry, Name, Layer, Visibility, Display, Drafting, Render
layer = ModelLayer(Name=layer_n_2, DisplayColour=dc_2)  # -> Layer, Name, Hidden, Locked, DisplayColour, Material, Linetype, PrintColour, PrintWidth
object_2 = ModelObject(group)
group_2 = NamedGroup(Geometry=group)  # -> Group, Geometry, Name
object_3 = ModelObject(Geometry=object_2, Layer=layer.Layer)  # -> Object, Geometry, Name, Layer, Visibility, Display, Drafting, Render
object_4 = ModelObject(Object=object_2)  # -> Object, Geometry, Name, Layer, Visibility, Display, Drafting, Render
block_definition = ModelBlockDefinition(Objects=object_3.Object, Name=name_2, URL=url_2)  # -> BlockDefinition, Objects, Units, Name, Notes, URL, URLDescription
panel = Panel(object_4.Layer)
export_definition = ExportModelBlockDefinition(BlockDefinition=block_definition.BlockDefinition, FilePath=path_2, Overwrite="T", Export=export_2)  # -> BlockDefinition, FilePath, Exported
block_definition_2 = ModelBlockDefinition(export_definition.BlockDefinition)
path_3 = FilePath(export_definition.FilePath)
exported = Boolean(export_definition.Exported)
path_4 = ClusterOutput(path_3)
exported_2 = ClusterOutput(exported)
block_definition_3 = ClusterOutput(block_definition_2)

# ==== cluster D
length = ClusterInput()
I = ClusterInput()
length_2 = Number(length)
domprop = DomainProperties(I=I, In=True)  # -> L, M, T0, T1; inputs I: tree, In: tree of Boolean
# ---------- domprop: Python ----------
#Component Information
#--------------------------------------------------------------------------------------------
if ghenv.Component.RunCount<2:
    #General
    #--------------------------------------------------------------------------------------------
    __author__ = "Ueli Saluz"
    __version__ = "2021.11.22"
    
    ghenv.Component.Name = "DomainProperties"
    ghenv.Component.NickName = "DomProp"
    ghenv.Component.Description = "Returns some properties of a domain"
    ghenv.Component.Message = "VER 1.0"
    ghenv.Component.Category = "Maths"
    ghenv.Component.SubCategory = "Domain"
    
     #Inputs
    #--------------------------------------------------------------------------------------------
    inputIndex=0
    
    ghenv.Component.Params.Input[inputIndex].Name = "Domain"
    ghenv.Component.Params.Input[inputIndex].NickName = "I"
    ghenv.Component.Params.Input[inputIndex].Description = "Domain to evaluate"
    ghenv.Component.Params.Input[inputIndex].Optional = False
    inputIndex+=1
    
    ghenv.Component.Params.Input[inputIndex].Name = "MakeIncreasing"
    ghenv.Component.Params.Input[inputIndex].NickName = "In"
    ghenv.Component.Params.Input[inputIndex].Description = "Makes sure that the domain is increasing. If not it gets swapped."
    ghenv.Component.Params.Input[inputIndex].Optional = False
    inputIndex+=1
    
    #Outputs
    #--------------------------------------------------------------------------------------------
    outputIndex=0
    
    ghenv.Component.Params.Output[outputIndex].Name = "Length"
    ghenv.Component.Params.Output[outputIndex].NickName = "L"
    ghenv.Component.Params.Output[outputIndex].Description = "Length of the domain"
    outputIndex+=1
    
    ghenv.Component.Params.Output[outputIndex].Name = "Mid"
    ghenv.Component.Params.Output[outputIndex].NickName = "M"
    ghenv.Component.Params.Output[outputIndex].Description = "Middle of the of the domain"
    outputIndex+=1
    
    ghenv.Component.Params.Output[outputIndex].Name = "DomainStartParameter"
    ghenv.Component.Params.Output[outputIndex].NickName = "T0"
    ghenv.Component.Params.Output[outputIndex].Description = "Start parameter. Doens't have to be smaller than the end parameter."
    outputIndex+=1
    
    ghenv.Component.Params.Output[outputIndex].Name = "DomainEndParameter"
    ghenv.Component.Params.Output[outputIndex].NickName = "T1"
    ghenv.Component.Params.Output[outputIndex].Description = "End parameter. Doens't have to be bigger than the start parameter."
    outputIndex+=1
    


#Imports
#--------------------------------------------------------------------------------------------
from System import Object
from Grasshopper import DataTree

#Solver - Run with trees to enhance performance drastically
#--------------------------------------------------------------------------------------------
if __name__ == "__main__":
    
    #Initialize trees
    #--------------------------------------------------------------------------------------------
    LengthTree = DataTree[Object]()
    MidTree = DataTree[Object]()
    DomainStartParameterTree = DataTree[Object]()
    DomainEndParameterTree = DataTree[Object]()
    LengthTree = DataTree[Object]()
    
    #Data matching
    #--------------------------------------------------------------------------------------------
    for path in I.Paths:
        domainBranch = I.Branch(path)
        for i,domain in enumerate(domainBranch):
            if In==True:
                domain.MakeIncreasing()
            LengthTree.Add(domain.Length, path)
            MidTree.Add(domain.Mid, path)
            DomainStartParameterTree.Add(domain.T0, path)
            DomainEndParameterTree.Add(domain.T1, path)
    
     #Assign trees to output
    #--------------------------------------------------------------------------------------------
    L = LengthTree
    M = MidTree
    T0 = DomainStartParameterTree
    T1 = DomainEndParameterTree
# ---------- end domprop ----------
addition = Addition(A=domprop.T1, B=length_2)
subtraction = Subtraction(A=domprop.T0, B=length_2)
dom = ConstructDomain(DomainStart=subtraction, DomainEnd=addition)
I_2 = ClusterOutput(dom)

# ==== cluster Cluster
gr = ClusterInput()
gr_2 = Group(gr)
group = NamedGroup(Group=gr_2)  # -> Group, Geometry, Name
group_2 = NamedGroup(Group=group.Geometry)  # -> Group, Geometry, Name
expression = Expression(x=graft(group.Name), y=group_2.Name, Expression="x")
group_3 = NamedGroup(Group=group_2.Geometry)  # -> Group, Geometry, Name
expression_2 = Expression(x=graft(expression), y=group_3.Name, Expression="x")
expression_3 = Expression(x=graft(group_2.Name), y=group_3.Name, Expression="x")
group_4 = NamedGroup(Group=group_3.Geometry)  # -> Group, Geometry, Name
expression_4 = Expression(x=graft(expression_2), y=group_4.Name, Expression="x")
expression_5 = Expression(x=graft(expression_3), y=group_4.Name, Expression="x")
expression_6 = Expression(x=graft(group_3.Name), y=group_4.Name, Expression="x")
group_5 = NamedGroup(Group=group_4.Geometry)  # -> Group, Geometry, Name
expression_7 = Expression(x=graft(expression_4), y=group_5.Name, Expression="x")
expression_8 = Expression(x=graft(expression_5), y=group_5.Name, Expression="x")
expression_9 = Expression(x=graft(expression_6), y=group_5.Name, Expression="x")
expression_10 = Expression(x=graft(group_4.Name), y=group_5.Name, Expression="x")
group_6 = NamedGroup(Group=group_5.Geometry)  # -> Group, Geometry, Name
expression_11 = Expression(x=graft(expression_7), y=group_6.Name, Expression="x")
expression_12 = Expression(x=graft(expression_9), y=group_6.Name, Expression="x")
expression_13 = Expression(x=graft(expression_8), y=group_6.Name, Expression="x")
expression_14 = Expression(x=graft(expression_10), y=group_6.Name, Expression="x")
expression_15 = Expression(x=graft(group_5.Name), y=group_6.Name, Expression="x")
merge = Merge(
    Data1=expression_11,
    Data2=expression_13,
    Data3=expression_12,
    Data4=expression_14,
    Data5=expression_15,
    Data6=group_6.Name)
join = TextJoin(Text=merge, Join="::")
geo = Geometry(group_6.Geometry)
txt = Text(join)
geo_2 = ClusterOutput(geo)
txt_2 = ClusterOutput(txt)
